# Grasshopper definition Comoda Ravenna.ghx (Grasshopper 1.0.8)

# ---- group: Dimensões principais
rh_in_01_2_profundidad_475 = Slider(475, range=200..600)
rh_in_01_1_altura_930 = Slider(930, range=400..1200)
rh_in_01_0_ancho_1295 = Slider(1295, range=300..1600)
subtraction = Subtraction(A=rh_in_01_1_altura_930)
domain_box = DomainBox(Base=PlaneXY(0, 0, 0), X=rh_in_01_0_ancho_1295, Y=rh_in_01_2_profundidad_475, Z=subtraction)

# ----
expression = Expression(
    x=rh_in_01_1_altura_930,
    y=rh_in_01_0_ancho_1295,
    Expression="if(x ≤ 500, 1, if(x ≤ 800, 2, if(x ≤ 1000, 3, if(x ≤ 1200, 4, 0))))")
area = Area(Geometry=domain_box)  # -> Area, Centroid
cantidad_cajones = Panel(expression)
yz_plane = YZPlane(Origin=area.Centroid)

# ---- group: Origen
deconstruct_brep = DeconstructBrep(Brep=domain_box)  # -> Faces, Edges, Vertices

# ----
mesh = Mesh(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)
point = Point(Point(-186.6000977, 13, 50))

_02_2_desfase = Slider(0, range=0..20)
_01_2_altura = Slider(9, range=0..20)

unit_y = UnitY(Factor="-0.1")
unit_z = UnitZ(Factor="16.5")
unit_y_2 = UnitY(Factor="6")

point_2 = Point(Point(-312.5, 12.5, 0))
cavilha = Mesh(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)

cantoneira = Mesh(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)
parafuso_e = Mesh([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])
point_3 = Point(Point(-368, 0, 7))

maquinados = Brep([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])
corredeça = Mesh(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)
corredeça_2 = Mesh(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)
corredeça_3 = Mesh(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)
point_4 = Point(Point(-420, 0, 0))

corredeça_4 = Mesh(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)
unit_x = UnitX(Factor="-0.4")

# ----
# Multiplocador de Verticales
panel = Panel("6")

# ----
# Costado Izquierdo
panel_2 = Panel("0")
altura_pata = Panel("50")
list_item = ListItem(List=deconstruct_brep.Vertices, Index=panel_2, Wrap=True)
unit_z_2 = UnitZ(Factor=altura_pata)
move = Move(Geometry=list_item, Motion=unit_z_2)  # -> Geometry, Transform
desfase = Panel("16")
unit_x_2 = UnitX(Factor=desfase)
list_item_2 = ListItem(List=move.Geometry, Index="4", Wrap=True)
move_2 = Move(Geometry=list_item_2, Motion=unit_x_2)  # -> Geometry, Transform
unit_y_3 = UnitY(Factor="20")
move_3 = Move(Geometry=move_2.Geometry, Motion=unit_y_3)  # -> Geometry, Transform

# ----
# Cubierta Superior
panel_3 = Panel("6")
unit_z_3 = UnitZ(Factor="-15")
list_item_3 = ListItem(List=deconstruct_brep.Vertices, Index="4", Wrap=True)
list_item_4 = ListItem(List=deconstruct_brep.Vertices, Index=panel_3, Wrap=True)
move_4 = Move(Geometry=list_item_3, Motion=unit_z_3)  # -> Geometry, Transform
addition = Addition(A=desfase, B="12")
unit_x_3 = UnitX(Factor=addition)

# ---- group: Peca 13
box_2pt = Box2Pt(PointA=move_4.Geometry, PointB=list_item_4, Plane=PlaneXY(0, 0, 0))

# ----
deconstruct_brep_2 = DeconstructBrep(Brep=box_2pt)  # -> Faces, Edges, Vertices
list_item_5 = ListItem(List=deconstruct_brep_2.Vertices, Index="3", Wrap=True)
move_5 = Move(Geometry=list_item_5, Motion=unit_x_3)  # -> Geometry, Transform

# ---- group: Peça 13 Aparência
# 3BF Materializer v0.3
# 3BF Box Mapping v1.0
# 3BF Mesh Channel Separator v2.2
rh_in_16_0_mapeado = ValueList({"Longitudinal": 0, "Atravesada": 1}, selected="Longitudinal")
python_3_script = Python3Script(Brep_In=box_2pt)  # -> out, Pieza_1, Pieza_2, Pieza_3, Pieza_4; inputs Brep_In: list of Brep
# ---------- python_3_script: Python ----------
"""
=============================================================================
3BF Materializer v1.0 (Clean Face Consolidator)
Powered by 3dBimFab
=============================================================================
Desglosa cada Closed Brep de entrada preservando el 100% de sus caras NURBS
(caras A/B, cantos perimetrales y mecanizados/ranuras con trimmed loops intactos)
y las emite consolidadas e independientes por pieza física (Pieza_1 a Pieza_4).
=============================================================================
"""
import Rhino

def consolidar_caras_pieza(brep_in):
    if brep_in is None:
        return [], "Brep nulo"

    bbox = brep_in.GetBoundingBox(True)
    x0, x1 = bbox.Min.X, bbox.Max.X
    y0, y1 = bbox.Min.Y, bbox.Max.Y
    z0, z1 = bbox.Min.Z, bbox.Max.Z

    sx = max(0.1, x1 - x0)
    sy = max(0.1, y1 - y0)
    sz = max(0.1, z1 - z0)
    min_dim = min(sx, sy, sz)

    tol = max(0.2, min_dim * 0.15)
    zona_bisel = max(tol * 2.5, min_dim * 2.5)

    faces_A = []
    faces_B = []
    faces_cantos = []
    faces_mecanizados = []

    # Extraer cada cara manteniendo los cortes de ranura intactos
    for i in range(brep_in.Faces.Count):
        f = brep_in.Faces[i]
        u = (f.Domain(0).T0 + f.Domain(0).T1) * 0.5
        v = (f.Domain(1).T0 + f.Domain(1).T1) * 0.5
        pt = f.PointAt(u, v)
        n = f.NormalAt(u, v)
        n.Unitize()
        nurbs_face = f.DuplicateFace(False)

        # Tablero Vertical Lateral (Espesor en X)
        if min_dim == sx:
            if n.X > 0.85 and abs(pt.X - x1) < tol:
                faces_A.append(nurbs_face)
            elif n.X < -0.85 and abs(pt.X - x0) < tol:
                faces_B.append(nurbs_face)
            elif (abs(pt.Y - y0) < zona_bisel or abs(y1 - pt.Y) < zona_bisel or
                  abs(pt.Z - z0) < zona_bisel or abs(z1 - pt.Z) < zona_bisel):
                faces_cantos.append(nurbs_face)
            else:
                faces_mecanizados.append(nurbs_face)

        # Tablero Horizontal (Espesor en Z)
        elif min_dim == sz:
            if n.Z > 0.85 and abs(pt.Z - z1) < tol:
                faces_A.append(nurbs_face)
            elif n.Z < -0.85 and abs(pt.Z - z0) < tol:
                faces_B.append(nurbs_face)
            elif (abs(pt.Y - y0) < zona_bisel or abs(y1 - pt.Y) < zona_bisel or
                  abs(pt.X - x0) < zona_bisel or abs(x1 - pt.X) < zona_bisel):
                faces_cantos.append(nurbs_face)
            else:
                faces_mecanizados.append(nurbs_face)

        # Tablero Vertical Frontal (Espesor en Y)
        else:
            if n.Y < -0.85 and abs(pt.Y - y0) < tol:
                faces_A.append(nurbs_face)
            elif n.Y > 0.85 and abs(pt.Y - y1) < tol:
                faces_B.append(nurbs_face)
            elif (abs(pt.X - x0) < zona_bisel or abs(x1 - pt.X) < zona_bisel or
                  abs(pt.Z - z0) < zona_bisel or abs(z1 - pt.Z) < zona_bisel):
                faces_cantos.append(nurbs_face)
            else:
                faces_mecanizados.append(nurbs_face)

    # Consolidar todas las caras que componen esta pieza
    todas_las_caras = []
    todas_las_caras.extend(faces_A)
    todas_las_caras.extend(faces_B)
    todas_las_caras.extend(faces_cantos)
    todas_las_caras.extend(faces_mecanizados)

    diag = "Caras: {} (A={}, B={}, Cantos={}, Mecanizados={})".format(
        len(todas_las_caras), len(faces_A), len(faces_B),
        len(faces_cantos), len(faces_mecanizados)
    )

    return todas_las_caras, diag


# -------------------------------------------------------------
# EJECUCIÓN PRINCIPAL
# -------------------------------------------------------------
lista_breps = []
if 'Brep_In' in locals() and Brep_In is not None:
    if hasattr(Brep_In, "__iter__") and not isinstance(Brep_In, Rhino.Geometry.Brep):
        lista_breps = [b for b in Brep_In if b is not None]
    else:
        lista_breps = [Brep_In]

resultados_piezas = []
diagnosticos = []

for idx, b in enumerate(lista_breps):
    caras, d_txt = consolidar_caras_pieza(b)
    resultados_piezas.append(caras)
    diagnosticos.append("Pieza {}: {}".format(idx + 1, d_txt))

# Salidas dedicadas por pieza (Pieza_1 a Pieza_4)
Pieza_1 = resultados_piezas[0] if len(resultados_piezas) > 0 else []
Pieza_2 = resultados_piezas[1] if len(resultados_piezas) > 1 else []
Pieza_3 = resultados_piezas[2] if len(resultados_piezas) > 2 else []
Pieza_4 = resultados_piezas[3] if len(resultados_piezas) > 3 else []

# Emisión directa hacia la consola de fábrica 'Out'
print("\n".join(diagnosticos) if diagnosticos else "Sin piezas de entrada")
# ---------- end python_3_script ----------
diagnostico = Panel(python_3_script.out)
mesh_brep = MeshBrep(
    Brep=python_3_script.Pieza_1,
    Settings={GridMaxCount=0, GridMinCount=16, JaggedSeams=False, MaxEdgeLength=0, MinEdgeLength=0.0001, MinTolerance=0, Refine=True, RefineAngle=0, RelativeTolerance=0.65, SimplePlanes=True, Tolerance=0})
rh_in_16_1_lado_balance = ValueList({"Cara A", "Cara B", "D/D"}, selected="Cara B")
rh_in_16_2_canto_frontal = ValueList({"Canto": 0, "MDP": 1}, selected="Canto")
rh_in_16_3_canto_trasero = ValueList({"Canto": 0, "MDP": 1}, selected="MDP")
rh_in_16_4_canto_izquierdo_arriba = ValueList({"Canto": 0, "MDP": 1}, selected="Canto")
rh_in_16_5_canto_derecho_abajo = ValueList({"Canto": 0, "MDP": 1}, selected="Canto")
mesh_join = MeshJoin(Meshes=flatten(mesh_brep))
python_3_script_2 = Python3Script(M=mesh_join, B=rh_in_16_0_mapeado)  # -> a; inputs M: Mesh, B: Int32
# ---------- python_3_script_2: Python ----------
"""
3BF Box Mapping v1.0 Cohesión Total
Respeta estrictamente la cohesión y topología proveniente de Mesh Join:
- CERO SplitDisjointPieces (no divide ni rompe mallas).
- CERO Unweld destructivo (mantiene la pieza 100% compacta y unida).
- Asigna coordenadas UV calculando la orientación de cada cara.
- Garantiza veta longitudinal a lo largo de cada tablero.
"""

import Rhino

def aplicar_box_mapping_cohesion_total(mesh_in, modo_veta=0, escala_caja_mm=600.0):
    if mesh_in is None or not isinstance(mesh_in, Rhino.Geometry.Mesh):
        return mesh_in

    # Preservar la malla cohesionada intacta sin romper vértices ni caras
    mesh = mesh_in.DuplicateMesh() if hasattr(mesh_in, "DuplicateMesh") else mesh_in
    
    mesh.Normals.ComputeNormals()
    mesh.TextureCoordinates.Clear()

    # Bounding Box individual de la pieza cohesionada
    bbox = mesh.GetBoundingBox(True)
    sx = max(1.0, bbox.Max.X - bbox.Min.X)
    sy = max(1.0, bbox.Max.Y - bbox.Min.Y)
    sz = max(1.0, bbox.Max.Z - bbox.Min.Z)

    es_atravesada = False
    if isinstance(modo_veta, str):
        es_atravesada = "atravesad" in modo_veta.lower() or modo_veta in ["1", "3", "5"]
    elif isinstance(modo_veta, (int, float)):
        es_atravesada = int(modo_veta) in [1, 3, 5]

    escala = float(escala_caja_mm)

    v_count = mesh.Vertices.Count
    norm_count = mesh.Normals.Count

    for idx in range(v_count):
        v = mesh.Vertices[idx]
        n = mesh.Normals[idx] if idx < norm_count else Rhino.Geometry.Vector3f(0, 0, 1)

        lx = v.X - bbox.Min.X
        ly = v.Y - bbox.Min.Y
        lz = v.Z - bbox.Min.Z

        nx, ny, nz = abs(n.X), abs(n.Y), abs(n.Z)

        # -------------------------------------------------------------
        # CASO A: Normal en Z (Caras Superiores / Inferiores / Cantos en Z)
        # -------------------------------------------------------------
        if nz >= nx and nz >= ny:
            if sy >= sx:
                # Lateral de cajón hacia el fondo (ej: 350mm en Y vs 15mm en X)
                u = ly / escala
                v_coord = lx / escala
            else:
                # Tablero horizontal normal o canto superior de frente (largo en X)
                u = ly / escala if es_atravesada else lx / escala
                v_coord = lx / escala if es_atravesada else ly / escala

        # -------------------------------------------------------------
        # CASO B: Normal en Y (Caras Frontales / Traseras / Cantos en Y)
        # -------------------------------------------------------------
        elif ny >= nx and ny >= nz:
            if sx >= sz:
                # Frente de cajón o traviesa horizontal (ancho en X)
                u = lz / escala if es_atravesada else lx / escala
                v_coord = lx / escala if es_atravesada else lz / escala
            else:
                # Pieza vertical alta
                u = lz / escala
                v_coord = lx / escala

        # -------------------------------------------------------------
        # CASO C: Normal en X (Caras Laterales / Cantos en X)
        # -------------------------------------------------------------
        else:
            if sy >= sz:
                # Lateral de cajón (cara plana hacia el fondo en Y)
                u = lz / escala if es_atravesada else ly / escala
                v_coord = ly / escala if es_atravesada else lz / escala
            else:
                # Costado vertical
                u = ly / escala if es_atravesada else lz / escala
                v_coord = lz / escala if es_atravesada else ly / escala

        mesh.TextureCoordinates.Add(float(u), float(v_coord))

    return mesh


# Ejecución universal compatible con Item Access o List Access
if isinstance(M, list):
    resultado = [aplicar_box_mapping_cohesion_total(item, B if 'B' in locals() else 0, 600.0) for item in M if item is not None]
else:
    resultado = aplicar_box_mapping_cohesion_total(M, B if 'B' in locals() else 0, 600.0)

a = resultado
# ---------- end python_3_script_2 ----------
python_3_script_3 = Python3Script(
    M_In=python_3_script_2,
    Balance_Mode=rh_in_16_1_lado_balance,
    Canto_1=rh_in_16_2_canto_frontal,
    Canto_2=rh_in_16_3_canto_trasero,
    Canto_3=rh_in_16_4_canto_izquierdo_arriba,
    Canto_4=rh_in_16_5_canto_derecho_abajo)  # -> out, Color, Balance, MDP; inputs M_In: list
# ---------- python_3_script_3: Python ----------
"""
=============================================================================
3BF Mesh Channel Separator v2.3 (Clean & Symmetry Aware)
Powered by 3dBimFab
=============================================================================
Separa la malla consolidada y mapeada en los 3 canales de manufactura DfMA:
1. Color: Caras principales y cantos aplacados.
2. Balance: Contracaras (respetando la simetría/espejo en parejas de cajones).
3. MDP: Mecanizados/ranuras y cantos sin aplacar.
La información de diagnóstico se emite directamente por la salida estándar 'out'.
=============================================================================
"""
import Rhino
import rhinoscriptsyntax as rs

def parse_balance(val):
    s = str(val).lower().strip().replace('"', '').replace("'", "")
    if s in ["6", "d/d", "dyd", "doble", "ninguno", "ambas"] or "d/d" in s or "dyd" in s:
        return "DD"
    if s in ["5", "cara a", "a"] or (s.startswith("a") and len(s) <= 6):
        return "A"
    if s in ["4", "cara b", "b"] or (s.startswith("b") and len(s) <= 6):
        return "B"
    return "B"

def parse_canto(val):
    s = str(val).lower().strip().replace('"', '').replace("'", "")
    if s in ["0", "0.0", "canto", "true", "si", "sí", "s", "con canto"] or ("canto" in s and "sin" not in s):
        return True
    if s in ["1", "1.0", "mdp", "false", "no", "sin canto"] or "mdp" in s or "sin" in s:
        return False
    return True

def extraer_malla_universal(c):
    if c is None:
        return None
    if hasattr(c, "Faces") and hasattr(c, "Vertices"):
        return c
    val = getattr(c, "Value", c)
    if hasattr(val, "Faces") and hasattr(val, "Vertices"):
        return val
    try:
        m = rs.coercemesh(c)
        if m is not None:
            return m
    except:
        pass
    try:
        m = rs.coercemesh(val)
        if m is not None:
            return m
    except:
        pass
    return None

def aplanar_candidatos(obj):
    res = []
    if obj is None:
        return res
    if hasattr(obj, "AllData"):
        for it in obj.AllData():
            res.extend(aplanar_candidatos(it))
        return res
    if hasattr(obj, "Branches"):
        for b in obj.Branches:
            res.extend(aplanar_candidatos(b))
        return res
    if isinstance(obj, list) or (hasattr(obj, "__iter__") and not hasattr(obj, "Faces")):
        for sub in obj:
            res.extend(aplanar_candidatos(sub))
        return res
    res.append(obj)
    return res

candidatos = aplanar_candidatos(M_In if 'M_In' in locals() else None)
lista_mallas = []
for c in candidatos:
    m = extraer_malla_universal(c)
    if m is not None and hasattr(m, "Faces") and m.Faces.Count > 0:
        lista_mallas.append(m)

def crear_submalla_uv(mesh_origen, face_indices):
    if not face_indices:
        return None
    sub = Rhino.Geometry.Mesh()
    vert_map = {}
    for fi in face_indices:
        f = mesh_origen.Faces[fi]
        idx_face = [f.A, f.B, f.C]
        if f.IsQuad:
            idx_face.append(f.D)

        nuevos_idx = []
        for vi in idx_face:
            if vi not in vert_map:
                new_vi = sub.Vertices.Add(mesh_origen.Vertices[vi])
                if mesh_origen.TextureCoordinates.Count > vi:
                    sub.TextureCoordinates.Add(mesh_origen.TextureCoordinates[vi])
                if mesh_origen.Normals.Count > vi:
                    sub.Normals.Add(mesh_origen.Normals[vi])
                vert_map[vi] = new_vi
            nuevos_idx.append(vert_map[vi])

        if len(nuevos_idx) == 3:
            sub.Faces.AddFace(nuevos_idx[0], nuevos_idx[1], nuevos_idx[2])
        elif len(nuevos_idx) == 4:
            sub.Faces.AddFace(nuevos_idx[0], nuevos_idx[1], nuevos_idx[2], nuevos_idx[3])

    sub.Compact()
    return sub

def separar_malla_pieza(mesh, b_mode, c1, c2, c3, c4):
    bb = mesh.GetBoundingBox(True)
    x0, x1 = bb.Min.X, bb.Max.X
    y0, y1 = bb.Min.Y, bb.Max.Y
    z0, z1 = bb.Min.Z, bb.Max.Z

    sx = max(0.1, x1 - x0)
    sy = max(0.1, y1 - y0)
    sz = max(0.1, z1 - z0)

    dims = [("X", sx), ("Y", sy), ("Z", sz)]
    dims.sort(key=lambda d: d[1])
    eje_espesor = dims[0][0]
    espesor = dims[0][1]
    tol = max(0.5, espesor * 0.25)

    faces_A_idx = []
    faces_B_idx = []
    cantos_idx = {1: [], 2: [], 3: [], 4: []}
    mecanizados_idx = []

    for fi in range(mesh.Faces.Count):
        f = mesh.Faces[fi]
        pts = [mesh.Vertices[f.A], mesh.Vertices[f.B], mesh.Vertices[f.C]]
        if f.IsQuad:
            pts.append(mesh.Vertices[f.D])

        cx = sum(p.X for p in pts) / len(pts)
        cy = sum(p.Y for p in pts) / len(pts)
        cz = sum(p.Z for p in pts) / len(pts)

        if eje_espesor == "X":
            if abs(cx - x1) < tol:
                faces_A_idx.append(fi)
            elif abs(cx - x0) < tol:
                faces_B_idx.append(fi)
            elif abs(cy - y0) < tol:
                cantos_idx[1].append(fi)
            elif abs(cy - y1) < tol:
                cantos_idx[2].append(fi)
            elif abs(cz - z1) < tol:
                cantos_idx[3].append(fi)
            elif abs(cz - z0) < tol:
                cantos_idx[4].append(fi)
            else:
                mecanizados_idx.append(fi)
        elif eje_espesor == "Z":
            if abs(cz - z1) < tol:
                faces_A_idx.append(fi)
            elif abs(cz - z0) < tol:
                faces_B_idx.append(fi)
            elif abs(cy - y0) < tol:
                cantos_idx[1].append(fi)
            elif abs(cy - y1) < tol:
                cantos_idx[2].append(fi)
            elif abs(cx - x0) < tol:
                cantos_idx[3].append(fi)
            elif abs(cx - x1) < tol:
                cantos_idx[4].append(fi)
            else:
                mecanizados_idx.append(fi)
        else:
            if abs(cy - y0) < tol:
                faces_A_idx.append(fi)
            elif abs(cy - y1) < tol:
                faces_B_idx.append(fi)
            elif abs(cx - x0) < tol:
                cantos_idx[1].append(fi)
            elif abs(cx - x1) < tol:
                cantos_idx[2].append(fi)
            elif abs(cz - z1) < tol:
                cantos_idx[3].append(fi)
            elif abs(cz - z0) < tol:
                cantos_idx[4].append(fi)
            else:
                mecanizados_idx.append(fi)

    # DETECCIÓN DE SIMETRÍA / MIRROR AUTOMÁTICA:
    # La ranura del fondo siempre mira al interior del cajón.
    # Si la ranura está en el lado opuesto (-X), es una pieza reflejada.
    es_espejo = False
    if mecanizados_idx:
        if eje_espesor == "X":
            pts_x = []
            for fi in mecanizados_idx:
                f = mesh.Faces[fi]
                pts_x.append(mesh.Vertices[f.A].X)
                pts_x.append(mesh.Vertices[f.B].X)
                pts_x.append(mesh.Vertices[f.C].X)
                if f.IsQuad: pts_x.append(mesh.Vertices[f.D].X)
            if pts_x and (sum(pts_x) / float(len(pts_x))) < (x0 + x1) * 0.5:
                es_espejo = True
        elif eje_espesor == "Y":
            pts_y = [mesh.Vertices[mesh.Faces[fi].A].Y for fi in mecanizados_idx]
            if pts_y and (sum(pts_y) / float(len(pts_y))) < (y0 + y1) * 0.5:
                es_espejo = True
        elif eje_espesor == "Z":
            pts_z = [mesh.Vertices[mesh.Faces[fi].A].Z for fi in mecanizados_idx]
            if pts_z and (sum(pts_z) / float(len(pts_z))) < (z0 + z1) * 0.5:
                es_espejo = True

    # Si es reflejada (espejo), invertimos las caras A y B para que el Balance quede adentro
    if es_espejo:
        f_A = faces_B_idx
        f_B = faces_A_idx
    else:
        f_A = faces_A_idx
        f_B = faces_B_idx

    color_idx = []
    balance_idx = []
    mdp_idx = []

    if b_mode == "DD":
        color_idx.extend(f_A)
        color_idx.extend(f_B)
    elif b_mode == "A":
        balance_idx.extend(f_A)
        color_idx.extend(f_B)
    elif b_mode == "B":
        color_idx.extend(f_A)
        balance_idx.extend(f_B)
    else:
        balance_idx.extend(f_A)
        balance_idx.extend(f_B)

    cantos_map = {1: c1, 2: c2, 3: c3, 4: c4}
    for num, tiene in cantos_map.items():
        if tiene:
            color_idx.extend(cantos_idx[num])
        else:
            mdp_idx.extend(cantos_idx[num])

    mdp_idx.extend(mecanizados_idx)

    m_col = crear_submalla_uv(mesh, color_idx)
    m_bal = crear_submalla_uv(mesh, balance_idx)
    m_mdp = crear_submalla_uv(mesh, mdp_idx)

    return m_col, m_bal, m_mdp

b_mode = parse_balance(Balance_Mode if 'Balance_Mode' in locals() else "Cara B")
c_1 = parse_canto(Canto_1 if 'Canto_1' in locals() else "Canto")
c_2 = parse_canto(Canto_2 if 'Canto_2' in locals() else "Canto")
c_3 = parse_canto(Canto_3 if 'Canto_3' in locals() else "Canto")
c_4 = parse_canto(Canto_4 if 'Canto_4' in locals() else "Canto")

Color = []
Balance = []
MDP = []

for m in lista_mallas:
    m_c, m_b, m_m = separar_malla_pieza(m, b_mode, c_1, c_2, c_3, c_4)
    if m_c is not None: Color.append(m_c)
    if m_b is not None: Balance.append(m_b)
    if m_m is not None: MDP.append(m_m)

# Diagnóstico emitido directamente hacia la salida estándar 'out'
print(f"Procesadas {len(lista_mallas)} mallas | Color={len(Color)}, Balance={len(Balance)}, MDP={len(MDP)}")
# ---------- end python_3_script_3 ----------
diagnostico_2 = Panel(python_3_script_3.out)
rh_out_mdp_peça_13 = Geometry(python_3_script_3.MDP)
rh_out_peça_13_b = Geometry(python_3_script_3.Balance)
rh_out_peça_13 = Geometry(python_3_script_3.Color)

# ----
box_2pt_2 = Box2Pt(PointA=move_3.Geometry, PointB=move_5.Geometry, Plane=PlaneXY(0, 0, 0))
deconstruct_brep_3 = DeconstructBrep(Brep=box_2pt_2)  # -> Faces, Edges, Vertices

# ---- group: Peca 10
mirror = Mirror(Geometry=box_2pt_2, Plane=yz_plane)  # -> Geometry, Transform

# ----
deconstruct_brep_4 = DeconstructBrep(Brep=mirror.Geometry)  # -> Faces, Edges, Vertices
deconstruct_brep_5 = DeconstructBrep(Brep=box_2pt_2)  # -> Faces, Edges, Vertices
list_item_6 = ListItem(List=deconstruct_brep_5.Edges, Index="2", Wrap=True)
list_item_7 = ListItem(List=deconstruct_brep_4.Edges, Index=panel, Wrap=True)
curve_middle = CurveMiddle(Curve=list_item_6)
curve_middle_2 = CurveMiddle(Curve=list_item_7)
distance = Distance(PointA=curve_middle, PointB=curve_middle_2)
expression_2 = Expression(x=distance, y=rh_in_01_0_ancho_1295, Expression="if(x<700, 1,2)")
division = Division(A=distance, B=expression_2)
unit_x_4 = UnitX(Factor=division)
stream_gate = StreamGate(Segmentos=unit_x_4, Gate=expression_2)  # -> Target0, Target1, Target2, Target3, Target4

# ----
# Zocalos
rh_in_01_4_altura_zocalo = Slider(73, range=50..120)
list_item_8 = ListItem(List=deconstruct_brep_3.Vertices, Index="1", Wrap=True)
unit_y_4 = UnitY(Factor="3")
move_6 = Move(Geometry=list_item_8, Motion=unit_y_4)  # -> Geometry, Transform
unit_y_5 = UnitY(Factor="12")
move_7 = Move(Geometry=move_6.Geometry, Motion=unit_y_5)  # -> Geometry, Transform
unit_z_4 = UnitZ(Factor=rh_in_01_4_altura_zocalo)
move_8 = Move(Geometry=move_7.Geometry, Motion=unit_z_4)  # -> Geometry, Transform

# ----
# Costado Derecho
deconstruct_brep_6 = DeconstructBrep(Brep=mirror.Geometry)  # -> Faces, Edges, Vertices
list_item_9 = ListItem(List=deconstruct_brep_6.Vertices, Index="5", Wrap=True)
unit_y_6 = UnitY(Factor="3")
unit_z_5 = UnitZ(Factor=rh_in_01_4_altura_zocalo)
move_9 = Move(Geometry=list_item_9, Motion=unit_y_6)  # -> Geometry, Transform
move_10 = Move(Geometry=list_item_9, Motion=unit_z_5)  # -> Geometry, Transform

# ----
# Paral Central
move_11 = Move(Geometry=box_2pt_2, Motion=stream_gate.Target2)  # -> Geometry, Transform
deconstruct_brep_7 = DeconstructBrep(Brep=move_11.Geometry)  # -> Faces, Edges, Vertices
list_item_10 = ListItem(List=deconstruct_brep_7.Vertices, Index="0", Wrap=True)
list_item_11 = ListItem(List=deconstruct_brep_7.Vertices, Index="6", Wrap=True)
addition_2 = Addition(A=rh_in_01_4_altura_zocalo, B="12")
unit_z_6 = UnitZ(Factor=addition_2)
move_12 = Move(Geometry=list_item_10, Motion=unit_z_6)  # -> Geometry, Transform

# ----
# Refuerzos Inferiores
panel_4 = Panel("1")
unit_z_7 = UnitZ(Factor=rh_in_01_4_altura_zocalo)
list_item_12 = ListItem(List=deconstruct_brep_3.Edges, Index=panel_4, Wrap=True)
move_13 = Move(Geometry=list_item_8, Motion=unit_z_7)  # -> Geometry, Transform
curve_middle_3 = CurveMiddle(Curve=list_item_12)
unit_z_8 = UnitZ(Factor="12")
xz_plane = XZPlane(Origin=curve_middle_3)
move_14 = Move(Geometry=move_13.Geometry, Motion=unit_z_8)  # -> Geometry, Transform
unit_y_7 = UnitY(Factor="80")
move_15 = Move(Geometry=move_14.Geometry, Motion=unit_y_7)  # -> Geometry, Transform

# ---- group: Peca 6
box_2pt_3 = Box2Pt(PointA=move_12.Geometry, PointB=list_item_11, Plane=PlaneXY(0, 0, 0))

# ---- group: Peca 4
box_2pt_4 = Box2Pt(PointA=move_15.Geometry, PointB=move_10.Geometry, Plane=PlaneXY(0, 0, 0))

# ---- group: Peca 1
box_2pt_5 = Box2Pt(PointA=move_8.Geometry, PointB=move_9.Geometry, Plane=PlaneXY(0, 0, 0))

# ---- group: Peca 5
mirror_2 = Mirror(Geometry=box_2pt_4, Plane=xz_plane)  # -> Geometry, Transform

# ----
unit_y_8 = UnitY(Factor="-1")
list_item_13 = ListItem(List=deconstruct_brep_3.Vertices, Index="6", Wrap=True)
move_16 = Move(Geometry=list_item_13, Motion=unit_y_8)  # -> Geometry, Transform
unit_z_9 = UnitZ(Factor="-120")
move_17 = Move(Geometry=move_16.Geometry, Motion=unit_z_9)  # -> Geometry, Transform
unit_y_9 = UnitY(Factor="-12")
move_18 = Move(Geometry=move_17.Geometry, Motion=unit_y_9)  # -> Geometry, Transform

unit_y_10 = UnitY(Factor="-1")
list_item_14 = ListItem(List=deconstruct_brep_7.Vertices, Index="7", Wrap=True)
move_19 = Move(Geometry=list_item_14, Motion=unit_y_10)  # -> Geometry, Transform

deconstruct_brep_8 = DeconstructBrep(Brep=box_2pt_5)  # -> Faces, Edges, Vertices
list_item_15 = ListItem(List=deconstruct_brep_8.Edges, Index="2", Wrap=True)
curve_middle_4 = CurveMiddle(Curve=list_item_15)
unit_x_5 = UnitX(Factor="6")
move_20 = Move(Geometry=curve_middle_4, Motion=unit_x_5)  # -> Geometry, Transform

# ---- group: Peca 3
mirror_3 = Mirror(Geometry=box_2pt_5, Plane=xz_plane)  # -> Geometry, Transform

# ----
unit_y_11 = UnitY(Factor="-1")
list_item_16 = ListItem(List=deconstruct_brep_7.Vertices, Index="6", Wrap=True)
move_21 = Move(Geometry=list_item_16, Motion=unit_y_11)  # -> Geometry, Transform
unit_z_10 = UnitZ(Factor="-120")
move_22 = Move(Geometry=move_21.Geometry, Motion=unit_z_10)  # -> Geometry, Transform
unit_y_12 = UnitY(Factor="-12")
move_23 = Move(Geometry=move_22.Geometry, Motion=unit_y_12)  # -> Geometry, Transform

deconstruct_brep_9 = DeconstructBrep(Brep=mirror_3.Geometry)  # -> Faces, Edges, Vertices
list_item_17 = ListItem(List=deconstruct_brep_9.Edges, Index="2", Wrap=True)
curve_middle_5 = CurveMiddle(Curve=list_item_17)
unit_x_6 = UnitX(Factor="-6")
move_24 = Move(Geometry=curve_middle_5, Motion=unit_x_6)  # -> Geometry, Transform

unit_y_13 = UnitY(Factor="-1")
list_item_18 = ListItem(List=deconstruct_brep_6.Vertices, Index="2", Wrap=True)
move_25 = Move(Geometry=list_item_18, Motion=unit_y_13)  # -> Geometry, Transform

# ---- group: Peça 4 Aparência
# 3BF Materializer v0.3
# 3BF Box Mapping v1.0
# 3BF Mesh Channel Separator v2.2
rh_in_07_0_mapeado = ValueList({"Longitudinal": 0, "Atravesada": 1}, selected="Longitudinal")
python_3_script_4 = Python3Script(Brep_In=box_2pt_4)  # -> out, Pieza_1, Pieza_2, Pieza_3, Pieza_4; inputs Brep_In: list of Brep; same code as python_3_script
mesh_brep_2 = MeshBrep(
    Brep=python_3_script_4.Pieza_1,
    Settings={GridMaxCount=0, GridMinCount=16, JaggedSeams=False, MaxEdgeLength=0, MinEdgeLength=0.0001, MinTolerance=0, Refine=True, RefineAngle=0, RelativeTolerance=0.65, SimplePlanes=True, Tolerance=0})
rh_in_07_1_lado_balance = ValueList({"Cara A", "Cara B", "D/D"}, selected="Cara B")
rh_in_07_2_canto_frontal = ValueList({"Canto": 0, "MDP": 1}, selected="Canto")
rh_in_07_3_canto_trasero = ValueList({"Canto": 0, "MDP": 1}, selected="MDP")
rh_in_07_4_canto_izquierdo_arriba = ValueList({"Canto": 0, "MDP": 1}, selected="MDP")
rh_in_07_5_canto_derecho_abajo = ValueList({"Canto": 0, "MDP": 1}, selected="MDP")
diagnostico_3 = Panel(python_3_script_4.out)
mesh_join_2 = MeshJoin(Meshes=flatten(mesh_brep_2))
python_3_script_5 = Python3Script(M=mesh_join_2, B=rh_in_07_0_mapeado)  # -> a; inputs M: Mesh, B: Int32; same code as python_3_script_2
python_3_script_6 = Python3Script(
    M_In=python_3_script_5,
    Balance_Mode=rh_in_07_1_lado_balance,
    Canto_1=rh_in_07_2_canto_frontal,
    Canto_2=rh_in_07_3_canto_trasero,
    Canto_3=rh_in_07_4_canto_izquierdo_arriba,
    Canto_4=rh_in_07_5_canto_derecho_abajo)  # -> out, Color, Balance, MDP; inputs M_In: list; same code as python_3_script_3
diagnostico_4 = Panel(python_3_script_6.out)
rh_out_mdp_peça_4 = Geometry(python_3_script_6.MDP)
rh_out_peça_4_b = Geometry(python_3_script_6.Balance)
rh_out_peça_4 = Geometry(python_3_script_6.Color)

# ---- group: Peça 5 Aparência
# 3BF Materializer v0.3
# 3BF Box Mapping v1.0
# 3BF Mesh Channel Separator v2.2
rh_in_08_0_mapeado = ValueList({"Longitudinal": 0, "Atravesada": 1}, selected="Longitudinal")
python_3_script_7 = Python3Script(Brep_In=mirror_2.Geometry)  # -> out, Pieza_1, Pieza_2, Pieza_3, Pieza_4; inputs Brep_In: list of Brep; same code as python_3_script
mesh_brep_3 = MeshBrep(
    Brep=python_3_script_7.Pieza_1,
    Settings={GridMaxCount=0, GridMinCount=16, JaggedSeams=False, MaxEdgeLength=0, MinEdgeLength=0.0001, MinTolerance=0, Refine=True, RefineAngle=0, RelativeTolerance=0.65, SimplePlanes=True, Tolerance=0})
rh_in_08_1_lado_balance = ValueList({"Cara A", "Cara B", "D/D"}, selected="Cara B")
rh_in_08_2_canto_frontal = ValueList({"Canto": 0, "MDP": 1}, selected="MDP")
rh_in_08_3_canto_trasero = ValueList({"Canto": 0, "MDP": 1}, selected="MDP")
rh_in_08_4_canto_izquierdo_arriba = ValueList({"Canto": 0, "MDP": 1}, selected="MDP")
rh_in_08_5_canto_derecho_abajo = ValueList({"Canto": 0, "MDP": 1}, selected="MDP")
diagnostico_5 = Panel(python_3_script_7.out)
mesh_join_3 = MeshJoin(Meshes=flatten(mesh_brep_3))
python_3_script_8 = Python3Script(M=mesh_join_3, B=rh_in_08_0_mapeado)  # -> a; inputs M: Mesh, B: Int32; same code as python_3_script_2
python_3_script_9 = Python3Script(
    M_In=python_3_script_8,
    Balance_Mode=rh_in_08_1_lado_balance,
    Canto_1=rh_in_08_2_canto_frontal,
    Canto_2=rh_in_08_3_canto_trasero,
    Canto_3=rh_in_08_4_canto_izquierdo_arriba,
    Canto_4=rh_in_08_5_canto_derecho_abajo)  # -> out, Color, Balance, MDP; inputs M_In: list; same code as python_3_script_3
diagnostico_6 = Panel(python_3_script_9.out)
rh_out_mdp_peça_5 = Geometry(python_3_script_9.MDP)
rh_out_peça_5_b = Geometry(python_3_script_9.Balance)
rh_out_peça_5 = Geometry(python_3_script_9.Color)

# ----
# Refuerzos Posteriores
box_2pt_6 = Box2Pt(PointA=move_18.Geometry, PointB=move_19.Geometry, Plane=PlaneXY(0, 0, 0))
box_2pt_7 = Box2Pt(PointA=move_23.Geometry, PointB=move_25.Geometry, Plane=PlaneXY(0, 0, 0))
box_2pt_8 = Box2Pt(PointA=move_18.Geometry, PointB=move_25.Geometry, Plane=PlaneXY(0, 0, 0))
stream_filter = StreamFilter(Gate=expression_2, Stream1=box_2pt_8, Stream2=[box_2pt_7, box_2pt_6])
dispatch = Dispatch(List=stream_filter, DispatchPattern=[True, False])  # -> ListA, ListB

# ---- group: Peca 12
brep = Brep(dispatch.ListA)

# ---- group: Peca 9
brep_2 = Brep(dispatch.ListB)

# ---- group: Peça 9 Aparência
# 3BF Materializer v0.3
# 3BF Box Mapping v1.0
# 3BF Mesh Channel Separator v2.2
rh_in_12_1_mapeado = ValueList({"Longitudinal": 0, "Atravesada": 1}, selected="Longitudinal")
python_3_script_10 = Python3Script(Brep_In=brep_2)  # -> out, Pieza_1, Pieza_2, Pieza_3, Pieza_4; inputs Brep_In: list of Brep; same code as python_3_script
mesh_brep_4 = MeshBrep(
    Brep=python_3_script_10.Pieza_1,
    Settings={GridMaxCount=0, GridMinCount=16, JaggedSeams=False, MaxEdgeLength=0, MinEdgeLength=0.0001, MinTolerance=0, Refine=True, RefineAngle=0, RelativeTolerance=0.65, SimplePlanes=True, Tolerance=0})
rh_in_12_2_lado_balance = ValueList({"Cara A", "Cara B", "D/D"}, selected="Cara A")
rh_in_12_3_canto_frontal = ValueList({"Canto": 0, "MDP": 1}, selected="MDP")
rh_in_12_4_canto_trasero = ValueList({"Canto": 0, "MDP": 1}, selected="MDP")
rh_in_12_5_canto_izquierdo_arriba = ValueList({"Canto": 0, "MDP": 1}, selected="Canto")
rh_in_12_6_canto_derecho_abajo = ValueList({"Canto": 0, "MDP": 1}, selected="MDP")
diagnostico_7 = Panel(python_3_script_10.out)
mesh_join_4 = MeshJoin(Meshes=flatten(mesh_brep_4))
python_3_script_11 = Python3Script(M=mesh_join_4, B=rh_in_12_1_mapeado)  # -> a; inputs M: Mesh, B: Int32; same code as python_3_script_2
python_3_script_12 = Python3Script(
    M_In=python_3_script_11,
    Balance_Mode=rh_in_12_2_lado_balance,
    Canto_1=rh_in_12_3_canto_frontal,
    Canto_2=rh_in_12_4_canto_trasero,
    Canto_3=rh_in_12_5_canto_izquierdo_arriba,
    Canto_4=rh_in_12_6_canto_derecho_abajo)  # -> out, Color, Balance, MDP; inputs M_In: list; same code as python_3_script_3
diagnostico_8 = Panel(python_3_script_12.out)
rh_out_mdp_peça_9 = Geometry(python_3_script_12.MDP)
rh_out_peça_9_b = Geometry(python_3_script_12.Balance)
rh_out_peça_9 = Geometry(python_3_script_12.Color)

# ---- group: Peça 12 Aparência
# 3BF Materializer v0.3
# 3BF Box Mapping v1.0
# 3BF Mesh Channel Separator v2.2
rh_in_15_1_mapeado = ValueList({"Longitudinal": 0, "Atravesada": 1}, selected="Longitudinal")
python_3_script_13 = Python3Script(Brep_In=brep)  # -> out, Pieza_1, Pieza_2, Pieza_3, Pieza_4; inputs Brep_In: list of Brep; same code as python_3_script
mesh_brep_5 = MeshBrep(
    Brep=python_3_script_13.Pieza_1,
    Settings={GridMaxCount=0, GridMinCount=16, JaggedSeams=False, MaxEdgeLength=0, MinEdgeLength=0.0001, MinTolerance=0, Refine=True, RefineAngle=0, RelativeTolerance=0.65, SimplePlanes=True, Tolerance=0})
diagnostico_9 = Panel(python_3_script_13.out)
rh_in_15_2_lado_balance = ValueList({"Cara A", "Cara B", "D/D"}, selected="Cara A")
rh_in_15_3_canto_frontal = ValueList({"Canto": 0, "MDP": 1}, selected="MDP")
rh_in_15_4_canto_trasero = ValueList({"Canto": 0, "MDP": 1}, selected="MDP")
rh_in_15_5_canto_izquierdo_arriba = ValueList({"Canto": 0, "MDP": 1}, selected="Canto")
rh_in_15_6_canto_derecho_abajo = ValueList({"Canto": 0, "MDP": 1}, selected="MDP")
mesh_join_5 = MeshJoin(Meshes=flatten(mesh_brep_5))
python_3_script_14 = Python3Script(M=mesh_join_5, B=rh_in_15_1_mapeado)  # -> a; inputs M: Mesh, B: Int32; same code as python_3_script_2
python_3_script_15 = Python3Script(
    M_In=python_3_script_14,
    Balance_Mode=rh_in_15_2_lado_balance,
    Canto_1=rh_in_15_3_canto_frontal,
    Canto_2=rh_in_15_4_canto_trasero,
    Canto_3=rh_in_15_5_canto_izquierdo_arriba,
    Canto_4=rh_in_15_6_canto_derecho_abajo)  # -> out, Color, Balance, MDP; inputs M_In: list; same code as python_3_script_3
diagnostico_10 = Panel(python_3_script_15.out)
rh_out_mdp_peça_12 = Geometry(python_3_script_15.MDP)
rh_out_peça_12_b = Geometry(python_3_script_15.Balance)
rh_out_peça_12 = Geometry(python_3_script_15.Color)

# ----
unit_y_14 = UnitY(Factor="0.6")
list_item_19 = ListItem(List=deconstruct_brep_3.Vertices, Index="5", Wrap=True)
move_26 = Move(Geometry=list_item_19, Motion=unit_y_14)  # -> Geometry, Transform
unit_z_11 = UnitZ(Factor="-60")
move_27 = Move(Geometry=move_26.Geometry, Motion=unit_z_11)  # -> Geometry, Transform
unit_y_15 = UnitY(Factor="12")
move_28 = Move(Geometry=move_27.Geometry, Motion=unit_y_15)  # -> Geometry, Transform

deconstruct_brep_10 = DeconstructBrep(Brep=box_2pt_4)  # -> Faces, Edges, Vertices
unit_z_12 = UnitZ(Factor="13.5")
list_item_20 = ListItem(List=deconstruct_brep_10.Vertices, Index="4", Wrap=True)
move_29 = Move(Geometry=list_item_20, Motion=unit_z_12)  # -> Geometry, Transform
unit_y_16 = UnitY(Factor="0.6")
move_30 = Move(Geometry=move_29.Geometry, Motion=unit_y_16)  # -> Geometry, Transform
line = Line(StartPoint=move_26.Geometry, EndPoint=move_30.Geometry)
length = Length(Curve=line)
division_2 = Division(A=length, B=cantidad_cajones)
panel_5 = Panel(division_2)
unit_z_13 = UnitZ(Factor=panel_5)
negative = Negative(Value=unit_z_13)

unit_y_17 = UnitY(Factor="0.6")
list_item_21 = ListItem(List=deconstruct_brep_7.Vertices, Index="4", Wrap=True)
move_31 = Move(Geometry=list_item_21, Motion=unit_y_17)  # -> Geometry, Transform

unit_y_18 = UnitY(Factor="0.6")
list_item_22 = ListItem(List=deconstruct_brep_7.Vertices, Index="5", Wrap=True)
move_32 = Move(Geometry=list_item_22, Motion=unit_y_18)  # -> Geometry, Transform
unit_z_14 = UnitZ(Factor="-60")
move_33 = Move(Geometry=move_32.Geometry, Motion=unit_z_14)  # -> Geometry, Transform
unit_y_19 = UnitY(Factor="12")
move_34 = Move(Geometry=move_33.Geometry, Motion=unit_y_19)  # -> Geometry, Transform

unit_y_20 = UnitY(Factor="0.6")
list_item_23 = ListItem(List=deconstruct_brep_6.Vertices, Index="1", Wrap=True)
move_35 = Move(Geometry=list_item_23, Motion=unit_y_20)  # -> Geometry, Transform

# ----
# Patas
vector_2pt = Vector2Pt(PointA=point, PointB=move_7.Geometry, Unitize=False)  # -> Vector, Length
move_36 = Move(Geometry=mesh, Motion=vector_2pt.Vector)  # -> Geometry, Transform

# ----
# Refuerzos Unico Inferior Movil
yz_plane_2 = YZPlane(Origin=curve_middle_4)
box_2pt_9 = Box2Pt(PointA=move_20.Geometry, PointB=move_24.Geometry, Plane=PlaneXY(0, 0, 0))
unit_x_7 = UnitX(Factor="-43.5")
move_37 = Move(Geometry=box_2pt_9, Motion=unit_x_7)  # -> Geometry, Transform

mirror_4 = Mirror(Geometry=move_36.Geometry, Plane=yz_plane_2)  # -> Geometry, Transform

# ---- group: Peça 2 Aparência
# 3BF Materializer v0.3
# 3BF Box Mapping v1.0
# 3BF Mesh Channel Separator v2.2
rh_in_05_1_mapeado = ValueList({"Longitudinal": 0, "Atravesada": 1}, selected="Longitudinal")
rh_in_05_0_posicion_pata = ValueList({"1": 0, "2": 1}, selected="2")
rh_in_05_2_lado_balance = ValueList({"Cara A", "Cara B", "D/D"}, selected="Cara A")
rh_in_05_3_canto_frontal = ValueList({"Canto": 0, "MDP": 1}, selected="MDP")
rh_in_05_4_canto_trasero = ValueList({"Canto": 0, "MDP": 1}, selected="MDP")
rh_in_05_5_canto_izquierdo_arriba = ValueList({"Canto": 0, "MDP": 1}, selected="Canto")
rh_in_05_6_canto_derecho_abajo = ValueList({"Canto": 0, "MDP": 1}, selected="MDP")

# ----
stream_filter_2 = StreamFilter(Gate=rh_in_05_0_posicion_pata, Stream0=box_2pt_9, Stream1=move_37.Geometry)

# ---- group: Peca 2
stream_filter_3 = StreamFilter(Gate=expression_2, Stream2=stream_filter_2)

# ----
deconstruct_brep_11 = DeconstructBrep(Brep=stream_filter_3)  # -> Faces, Edges, Vertices
list_item_24 = ListItem(List=deconstruct_brep_11.Vertices, Index="1", Wrap=True)

vector_2pt_2 = Vector2Pt(PointA=point, PointB=list_item_24, Unitize=False)  # -> Vector, Length
move_38 = Move(Geometry=mesh, Motion=vector_2pt_2.Vector)  # -> Geometry, Transform
mirror_5 = Mirror(Geometry=[mirror_4.Geometry, move_38.Geometry, move_36.Geometry], Plane=xz_plane)  # -> Geometry, Transform
rh_out_pes = Geometry([mirror_4.Geometry, mirror_5.Geometry, move_36.Geometry, move_38.Geometry])

# ---- group: Peça 2 Aparência (continued)
python_3_script_16 = Python3Script(Brep_In=stream_filter_3)  # -> out, Pieza_1, Pieza_2, Pieza_3, Pieza_4; inputs Brep_In: list of Brep; same code as python_3_script
diagnostico_11 = Panel(python_3_script_16.out)
mesh_brep_6 = MeshBrep(
    Brep=python_3_script_16.Pieza_1,
    Settings={GridMaxCount=0, GridMinCount=16, JaggedSeams=False, MaxEdgeLength=0, MinEdgeLength=0.0001, MinTolerance=0, Refine=True, RefineAngle=0, RelativeTolerance=0.65, SimplePlanes=True, Tolerance=0})
mesh_join_6 = MeshJoin(Meshes=flatten(mesh_brep_6))
python_3_script_17 = Python3Script(M=mesh_join_6, B=rh_in_05_1_mapeado)  # -> a; inputs M: Mesh, B: Int32; same code as python_3_script_2
python_3_script_18 = Python3Script(
    M_In=python_3_script_17,
    Balance_Mode=rh_in_05_2_lado_balance,
    Canto_1=rh_in_05_3_canto_frontal,
    Canto_2=rh_in_05_4_canto_trasero,
    Canto_3=rh_in_05_5_canto_izquierdo_arriba,
    Canto_4=rh_in_05_6_canto_derecho_abajo)  # -> out, Color, Balance, MDP; inputs M_In: list; same code as python_3_script_3
diagnostico_12 = Panel(python_3_script_18.out)
rh_out_mdp_peça_2 = Geometry(python_3_script_18.MDP)
rh_out_peça_2_b = Geometry(python_3_script_18.Balance)
rh_out_peça_2 = Geometry(python_3_script_18.Color)

# ----
# Distribucion Tapaluces - Frente de Cajon
panel_6 = Panel("0")
unit_y_21 = UnitY(Factor="-0.6")
unit_y_22 = UnitY(Factor="-0.6")
unit_z_15 = UnitZ(Factor="20")
unit_z_16 = UnitZ(Factor="20")
unit_x_8 = UnitX(Factor="-4")
unit_x_9 = UnitX(Factor="4")
subtraction_2 = Subtraction(A=cantidad_cajones, B="1")
multiplication = Multiplication(A=subtraction_2, B="36")
unit_y_23 = UnitY(Factor="-15")

# ----
# Tapaluces - Frente de Cajon
panel_7 = Panel("8")
unit_z_17 = UnitZ(Factor=panel_7)
move_39 = Move(Geometry=list_item_20, Motion=unit_z_17)  # -> Geometry, Transform
unit_x_10 = UnitX(Factor="-4")
unit_y_24 = UnitY(Factor="-0.6")
move_40 = Move(Geometry=move_39.Geometry, Motion=unit_x_10)  # -> Geometry, Transform
unit_y_25 = UnitY(Factor="-0.6")
unit_z_18 = UnitZ(Factor="20")
unit_z_19 = UnitZ(Factor="20")
subtraction_3 = Subtraction(A=cantidad_cajones, B="1")
negative_2 = Negative(Value="4")
unit_x_11 = UnitX(Factor=negative_2)
unit_x_12 = UnitX(Factor="4")
multiplication_2 = Multiplication(A=subtraction_3, B="36")
unit_y_26 = UnitY(Factor="-15")

# ----
# Maquinados Lateral de Cajon
panel_8 = Panel("4")
unit_z_20 = UnitZ(Factor="-11.1")
unit_y_27 = UnitY(Factor="-9")
rh_in_02_1_ritmo = ValueList({"32", "64", "96"}, selected="64")
unit_z_21 = UnitZ(Factor=rh_in_02_1_ritmo)
negative_3 = Negative(Value=unit_z_21)

unit_z_22 = UnitZ(Factor=rh_in_02_1_ritmo)
negative_4 = Negative(Value=unit_z_22)

# ----
# Lateral de Cajon
panel_9 = Panel("14")
unit_x_13 = UnitX(Factor=panel_9)
rh_in_02_0_altura_lateral_de_cajon = ValueList({"80", "110", "120"}, selected="110")
unit_z_23 = UnitZ(Factor="17.5")
unit_z_24 = UnitZ(Factor=rh_in_02_0_altura_lateral_de_cajon)
unit_x_14 = UnitX(Factor="12")
unit_y_28 = UnitY(Factor="350")

# ---- group: Ranuras Laterales
unit_z_25 = UnitZ(Factor="16.5")
unit_x_15 = UnitX(Factor="6")
unit_x_16 = UnitX(Factor="6")

# ----
# Fondo de Cajon
panel_10 = Panel("12.5")
unit_z_26 = UnitZ(Factor=panel_10)
unit_x_17 = UnitX(Factor="0.5")
espesor_mdf = Panel("3")
unit_y_29 = UnitY(Factor="0.5")
unit_z_27 = UnitZ(Factor=espesor_mdf)
unit_y_30 = UnitY(Factor="-5.5")

# ----
# Maquinados Frente de Cajon
panel_11 = Panel("7")
unit_y_31 = UnitY(Factor="-10")
unit_z_28 = UnitZ(Factor="-20")
unit_z_29 = UnitZ(Factor="30")
unit_z_30 = UnitZ(Factor="34")
unit_x_18 = UnitX(Factor="4")
unit_x_19 = UnitX(Factor="-4")
unit_y_32 = UnitY(Factor="-6")

# ----
# Tapaluces
box_2pt_10 = Box2Pt(PointA=move_28.Geometry, PointB=move_31.Geometry, Plane=PlaneXY(0, 0, 0))
box_2pt_11 = Box2Pt(PointA=move_28.Geometry, PointB=move_35.Geometry, Plane=PlaneXY(0, 0, 0))
box_2pt_12 = Box2Pt(PointA=move_34.Geometry, PointB=move_35.Geometry, Plane=PlaneXY(0, 0, 0))
deconstruct_brep_12 = DeconstructBrep(Brep=box_2pt_12)  # -> Faces, Edges, Vertices
list_item_25 = ListItem(List=deconstruct_brep_12.Vertices, Index=0, Wrap=True)
panel_12 = Panel(cantidad_cajones)

deconstruct_brep_13 = DeconstructBrep(Brep=box_2pt_10)  # -> Faces, Edges, Vertices
list_item_26 = ListItem(List=deconstruct_brep_13.Vertices, Index="1", Wrap=True)
list_item_27 = ListItem(List=deconstruct_brep_13.Vertices, Index="0", Wrap=True)
move_41 = Move(Geometry=list_item_27, Motion=unit_y_24)  # -> Geometry, Transform
move_42 = Move(Geometry=list_item_26, Motion=unit_y_25)  # -> Geometry, Transform
move_43 = Move(Geometry=move_41.Geometry, Motion=unit_z_18)  # -> Geometry, Transform
move_44 = Move(Geometry=move_42.Geometry, Motion=unit_z_19)  # -> Geometry, Transform
move_45 = Move(Geometry=move_43.Geometry, Motion=unit_x_11)  # -> Geometry, Transform
line_2 = Line(StartPoint=move_40.Geometry, EndPoint=move_45.Geometry)
length_2 = Length(Curve=line_2)
panel_13 = Panel(length_2)
subtraction_4 = Subtraction(A=length_2, B=multiplication_2)
move_46 = Move(Geometry=move_44.Geometry, Motion=unit_x_12)  # -> Geometry, Transform
division_3 = Division(A=subtraction_4, B=cantidad_cajones)
panel_14 = Panel(division_3)
addition_3 = Addition(A=panel_14, B="1")
panel_15 = Panel(addition_3)
unit_z_31 = UnitZ(Factor=panel_15)
negative_5 = Negative(Value=unit_z_31)
move_47 = Move(Geometry=move_46.Geometry, Motion=negative_5)  # -> Geometry, Transform
move_48 = Move(Geometry=move_47.Geometry, Motion=unit_y_26)  # -> Geometry, Transform
box_2pt_13 = Box2Pt(PointA=move_45.Geometry, PointB=move_48.Geometry, Plane=PlaneXY(0, 0, 0))

deconstruct_brep_14 = DeconstructBrep(Brep=box_2pt_11)  # -> Faces, Edges, Vertices
list_item_28 = ListItem(List=deconstruct_brep_14.Vertices, Index=panel_6, Wrap=True)
list_item_29 = ListItem(List=deconstruct_brep_14.Vertices, Index="1", Wrap=True)
move_49 = Move(Geometry=list_item_28, Motion=unit_y_21)  # -> Geometry, Transform
move_50 = Move(Geometry=list_item_29, Motion=unit_y_22)  # -> Geometry, Transform
move_51 = Move(Geometry=move_49.Geometry, Motion=unit_z_15)  # -> Geometry, Transform
move_52 = Move(Geometry=move_50.Geometry, Motion=unit_z_16)  # -> Geometry, Transform
move_53 = Move(Geometry=move_51.Geometry, Motion=unit_x_8)  # -> Geometry, Transform
move_54 = Move(Geometry=move_52.Geometry, Motion=unit_x_9)  # -> Geometry, Transform
line_3 = Line(StartPoint=move_53.Geometry, EndPoint=move_40.Geometry)
length_3 = Length(Curve=line_3)
subtraction_5 = Subtraction(A=length_3, B=multiplication)
division_4 = Division(A=subtraction_5, B=cantidad_cajones)
panel_16 = Panel(division_4)
addition_4 = Addition(A=panel_16, B="1")
panel_17 = Panel(addition_4)
unit_z_32 = UnitZ(Factor=panel_17)
negative_6 = Negative(Value=unit_z_32)
move_55 = Move(Geometry=move_54.Geometry, Motion=negative_6)  # -> Geometry, Transform
move_56 = Move(Geometry=move_55.Geometry, Motion=unit_y_23)  # -> Geometry, Transform
box_2pt_14 = Box2Pt(PointA=move_53.Geometry, PointB=move_56.Geometry, Plane=PlaneXY(0, 0, 0))
stream_filter_4 = StreamFilter(Gate=expression_2, Stream1=box_2pt_14, Stream2=box_2pt_13)

# ---- group: Peca 8
stream_filter_5 = StreamFilter(Gate=expression_2, Stream1=box_2pt_11, Stream2=[box_2pt_12, box_2pt_10])

# ----
dispatch_2 = Dispatch(List=stream_filter_5, DispatchPattern=[True, False])  # -> ListA, ListB
dispatch_3 = Dispatch(List=stream_filter_5, DispatchPattern=[True, False])  # -> ListA, ListB
brep_3 = Brep(dispatch_3.ListA)
brep_4 = Brep(dispatch_3.ListB)
stream_filter_6 = StreamFilter(Gate=expression_2, Stream1=brep_3, Stream2=brep_4)
deconstruct_brep_15 = DeconstructBrep(Brep=stream_filter_6)  # -> Faces, Edges, Vertices
list_item_30 = ListItem(List=deconstruct_brep_15.Edges, Index=0, Wrap=True)
curve_middle_6 = CurveMiddle(Curve=list_item_30)
yz_plane_3 = YZPlane(Origin=curve_middle_6)

# ---- group: Peca 11
linear_array = LinearArray(Geometry=dispatch_2.ListA, Direction=negative, Count=cantidad_cajones)  # -> Geometry, Transform

# ---- group: Peca 8
linear_array_2 = LinearArray(Geometry=dispatch_2.ListB, Direction=negative, Count=cantidad_cajones)  # -> Geometry, Transform

# ---- group: Peça 11 Aparência
# 3BF Materializer v0.3
# 3BF Box Mapping v1.0
# 3BF Mesh Channel Separator v2.2
rh_in_14_0_mapeado = ValueList({"Longitudinal": 0, "Atravesada": 1}, selected="Longitudinal")
python_3_script_19 = Python3Script(Brep_In=linear_array.Geometry)  # -> out, Pieza_1, Pieza_2, Pieza_3, Pieza_4; inputs Brep_In: list of Brep; same code as python_3_script
diagnostico_13 = Panel(python_3_script_19.out)
mesh_brep_7 = MeshBrep(
    Brep=python_3_script_19.Pieza_1,
    Settings={GridMaxCount=0, GridMinCount=16, JaggedSeams=False, MaxEdgeLength=0, MinEdgeLength=0.0001, MinTolerance=0, Refine=True, RefineAngle=0, RelativeTolerance=0.65, SimplePlanes=True, Tolerance=0})
mesh_brep_8 = MeshBrep(
    Brep=python_3_script_19.Pieza_2,
    Settings={GridMaxCount=0, GridMinCount=16, JaggedSeams=False, MaxEdgeLength=0, MinEdgeLength=0.0001, MinTolerance=0, Refine=True, RefineAngle=0, RelativeTolerance=0.65, SimplePlanes=True, Tolerance=0})
mesh_brep_9 = MeshBrep(
    Brep=python_3_script_19.Pieza_3,
    Settings={GridMaxCount=0, GridMinCount=16, JaggedSeams=False, MaxEdgeLength=0, MinEdgeLength=0.0001, MinTolerance=0, Refine=True, RefineAngle=0, RelativeTolerance=0.65, SimplePlanes=True, Tolerance=0})
mesh_brep_10 = MeshBrep(
    Brep=python_3_script_19.Pieza_4,
    Settings={GridMaxCount=0, GridMinCount=16, JaggedSeams=False, MaxEdgeLength=0, MinEdgeLength=0.0001, MinTolerance=0, Refine=True, RefineAngle=0, RelativeTolerance=0.65, SimplePlanes=True, Tolerance=0})
rh_in_14_1_lado_balance = ValueList({"Cara A", "Cara B", "D/D"}, selected="Cara B")
rh_in_14_2_canto_frontal = ValueList({"Canto": 0, "MDP": 1}, selected="MDP")
rh_in_14_3_canto_trasero = ValueList({"Canto": 0, "MDP": 1}, selected="MDP")
rh_in_14_4_canto_izquierdo_arriba = ValueList({"Canto": 0, "MDP": 1}, selected="Canto")
rh_in_14_5_canto_derecho_abajo = ValueList({"Canto": 0, "MDP": 1}, selected="MDP")
mesh_join_7 = MeshJoin(Meshes=flatten(mesh_brep_7))
mesh_join_8 = MeshJoin(Meshes=flatten(mesh_brep_8))
mesh_join_9 = MeshJoin(Meshes=flatten(mesh_brep_9))
mesh_join_10 = MeshJoin(Meshes=flatten(mesh_brep_10))
python_3_script_20 = Python3Script(M=mesh_join_7, B=rh_in_14_0_mapeado)  # -> a; inputs M: Mesh, B: Int32; same code as python_3_script_2
python_3_script_21 = Python3Script(M=mesh_join_8, B=rh_in_14_0_mapeado)  # -> a; inputs M: Mesh, B: Int32; same code as python_3_script_2
python_3_script_22 = Python3Script(M=mesh_join_9, B=rh_in_14_0_mapeado)  # -> a; inputs M: Mesh, B: Int32; same code as python_3_script_2
python_3_script_23 = Python3Script(M=mesh_join_10, B=rh_in_14_0_mapeado)  # -> a; inputs M: Mesh, B: Int32; same code as python_3_script_2
python_3_script_24 = Python3Script(
    M_In=[python_3_script_20, python_3_script_21, python_3_script_22, python_3_script_23],
    Balance_Mode=rh_in_14_1_lado_balance,
    Canto_1=rh_in_14_2_canto_frontal,
    Canto_2=rh_in_14_3_canto_trasero,
    Canto_3=rh_in_14_4_canto_izquierdo_arriba,
    Canto_4=rh_in_14_5_canto_derecho_abajo)  # -> out, Color, Balance, MDP; inputs M_In: list; same code as python_3_script_3
diagnostico_14 = Panel(python_3_script_24.out)
rh_out_mdp_peça_11 = Geometry(python_3_script_24.MDP)
rh_out_peça_11_b = Geometry(python_3_script_24.Balance)
rh_out_peça_11 = Geometry(python_3_script_24.Color)

# ---- group: Peça 8 Aparência
# 3BF Materializer v0.3
# 3BF Box Mapping v1.0
# 3BF Mesh Channel Separator v2.2
rh_in_11_0_mapeado = ValueList({"Longitudinal": 0, "Atravesada": 1}, selected="Longitudinal")
python_3_script_25 = Python3Script(Brep_In=linear_array_2.Geometry)  # -> out, Pieza_1, Pieza_2, Pieza_3, Pieza_4; inputs Brep_In: list of Brep; same code as python_3_script
diagnostico_15 = Panel(python_3_script_25.out)
mesh_brep_11 = MeshBrep(
    Brep=python_3_script_25.Pieza_1,
    Settings={GridMaxCount=0, GridMinCount=16, JaggedSeams=False, MaxEdgeLength=0, MinEdgeLength=0.0001, MinTolerance=0, Refine=True, RefineAngle=0, RelativeTolerance=0.65, SimplePlanes=True, Tolerance=0})
mesh_brep_12 = MeshBrep(
    Brep=python_3_script_25.Pieza_2,
    Settings={GridMaxCount=0, GridMinCount=16, JaggedSeams=False, MaxEdgeLength=0, MinEdgeLength=0.0001, MinTolerance=0, Refine=True, RefineAngle=0, RelativeTolerance=0.65, SimplePlanes=True, Tolerance=0})
mesh_brep_13 = MeshBrep(
    Brep=python_3_script_25.Pieza_3,
    Settings={GridMaxCount=0, GridMinCount=16, JaggedSeams=False, MaxEdgeLength=0, MinEdgeLength=0.0001, MinTolerance=0, Refine=True, RefineAngle=0, RelativeTolerance=0.65, SimplePlanes=True, Tolerance=0})
mesh_brep_14 = MeshBrep(
    Brep=python_3_script_25.Pieza_4,
    Settings={GridMaxCount=0, GridMinCount=16, JaggedSeams=False, MaxEdgeLength=0, MinEdgeLength=0.0001, MinTolerance=0, Refine=True, RefineAngle=0, RelativeTolerance=0.65, SimplePlanes=True, Tolerance=0})
rh_in_11_1_lado_balance = ValueList({"Cara A", "Cara B", "D/D"}, selected="Cara B")
rh_in_11_2_canto_frontal = ValueList({"Canto": 0, "MDP": 1}, selected="MDP")
rh_in_11_3_canto_trasero = ValueList({"Canto": 0, "MDP": 1}, selected="MDP")
rh_in_11_4_canto_izquierdo_arriba = ValueList({"Canto": 0, "MDP": 1}, selected="Canto")
rh_in_11_5_canto_derecho_abajo = ValueList({"Canto": 0, "MDP": 1}, selected="MDP")
mesh_join_11 = MeshJoin(Meshes=flatten(mesh_brep_11))
mesh_join_12 = MeshJoin(Meshes=flatten(mesh_brep_12))
mesh_join_13 = MeshJoin(Meshes=flatten(mesh_brep_13))
mesh_join_14 = MeshJoin(Meshes=flatten(mesh_brep_14))
python_3_script_26 = Python3Script(M=mesh_join_11, B=rh_in_11_0_mapeado)  # -> a; inputs M: Mesh, B: Int32; same code as python_3_script_2
python_3_script_27 = Python3Script(M=mesh_join_12, B=rh_in_11_0_mapeado)  # -> a; inputs M: Mesh, B: Int32; same code as python_3_script_2
python_3_script_28 = Python3Script(M=mesh_join_13, B=rh_in_11_0_mapeado)  # -> a; inputs M: Mesh, B: Int32; same code as python_3_script_2
python_3_script_29 = Python3Script(M=mesh_join_14, B=rh_in_11_0_mapeado)  # -> a; inputs M: Mesh, B: Int32; same code as python_3_script_2
python_3_script_30 = Python3Script(
    M_In=[python_3_script_26, python_3_script_27, python_3_script_28, python_3_script_29],
    Balance_Mode=rh_in_11_1_lado_balance,
    Canto_1=rh_in_11_2_canto_frontal,
    Canto_2=rh_in_11_3_canto_trasero,
    Canto_3=rh_in_11_4_canto_izquierdo_arriba,
    Canto_4=rh_in_11_5_canto_derecho_abajo)  # -> out, Color, Balance, MDP; inputs M_In: list; same code as python_3_script_3
diagnostico_16 = Panel(python_3_script_30.out)
rh_out_mdp_peça_8 = Geometry(python_3_script_30.MDP)
rh_out_peça_8_b = Geometry(python_3_script_30.Balance)
rh_out_peça_8 = Geometry(python_3_script_30.Color)

# ----
deconstruct_brep_16 = DeconstructBrep(Brep=stream_filter_4)  # -> Faces, Edges, Vertices
list_item_31 = ListItem(List=deconstruct_brep_16.Vertices, Index="3", Wrap=True)
move_57 = Move(Geometry=list_item_31, Motion=unit_x_13)  # -> Geometry, Transform
move_58 = Move(Geometry=move_57.Geometry, Motion=unit_z_23)  # -> Geometry, Transform
move_59 = Move(Geometry=move_58.Geometry, Motion=unit_z_24)  # -> Geometry, Transform
move_60 = Move(Geometry=move_59.Geometry, Motion=unit_x_14)  # -> Geometry, Transform
move_61 = Move(Geometry=move_60.Geometry, Motion=unit_y_28)  # -> Geometry, Transform
box_2pt_15 = Box2Pt(PointA=move_58.Geometry, PointB=move_61.Geometry, Plane=PlaneXY(0, 0, 0))
vector_2pt_3 = Vector2Pt(PointA=list_item_27, PointB=list_item_25, Unitize=False)  # -> Vector, Length

deconstruct_brep_17 = DeconstructBrep(Brep=box_2pt_15)  # -> Faces, Edges, Vertices
list_item_32 = ListItem(List=deconstruct_brep_17.Edges, Index=panel_8, Wrap=True)
curve_middle_7 = CurveMiddle(Curve=list_item_32)
move_62 = Move(Geometry=curve_middle_7, Motion=unit_z_20)  # -> Geometry, Transform
move_63 = Move(Geometry=move_62.Geometry, Motion=unit_y_27)  # -> Geometry, Transform
xz_plane_2 = XZPlane(Origin=move_63.Geometry)
cylinder = Cylinder(Base=xz_plane_2, Radius="2.5", Length="-27")
area_2 = Area(Geometry=box_2pt_15)  # -> Area, Centroid
xz_plane_3 = XZPlane(Origin=area_2.Centroid)

cap_holes = CapHoles(Brep=cylinder)
move_64 = Move(Geometry=cap_holes, Motion=negative_3)  # -> Geometry, Transform
mirror_6 = Mirror(Geometry=[cap_holes, move_64.Geometry], Plane=xz_plane_3)  # -> Geometry, Transform

deconstruct_brep_18 = DeconstructBrep(Brep=box_2pt_15)  # -> Faces, Edges, Vertices
deconstruct_brep_19 = DeconstructBrep(Brep=cap_holes)  # -> Faces, Edges, Vertices
list_item_33 = ListItem(List=deconstruct_brep_18.Edges, Index="9", Wrap=True)
list_item_34 = ListItem(List=deconstruct_brep_19.Edges, Index="0", Wrap=True)
curve_middle_8 = CurveMiddle(Curve=list_item_33)
area_3 = Area(Geometry=list_item_34)  # -> Area, Centroid
vector_2pt_4 = Vector2Pt(PointA=point_4, PointB=list_item_31, Unitize=False)  # -> Vector, Length
vector_2pt_5 = Vector2Pt(PointA=point_3, PointB=curve_middle_8, Unitize=False)  # -> Vector, Length
vector_2pt_6 = Vector2Pt(PointA=point_3, PointB=curve_middle_8, Unitize=False)  # -> Vector, Length
vector_2pt_7 = Vector2Pt(PointA=point_2, PointB=area_3.Centroid, Unitize=False)  # -> Vector, Length
move_65 = Move(Geometry=maquinados, Motion=vector_2pt_4.Vector)  # -> Geometry, Transform
move_66 = Move(Geometry=corredeça, Motion=vector_2pt_4.Vector)  # -> Geometry, Transform
move_67 = Move(Geometry=corredeça_2, Motion=vector_2pt_4.Vector)  # -> Geometry, Transform
move_68 = Move(Geometry=corredeça_3, Motion=vector_2pt_4.Vector)  # -> Geometry, Transform
move_69 = Move(Geometry=corredeça_4, Motion=vector_2pt_4.Vector)  # -> Geometry, Transform
move_70 = Move(Geometry=cantoneira, Motion=vector_2pt_5.Vector)  # -> Geometry, Transform
move_71 = Move(Geometry=parafuso_e, Motion=vector_2pt_6.Vector)  # -> Geometry, Transform
move_72 = Move(Geometry=cavilha, Motion=vector_2pt_7.Vector)  # -> Geometry, Transform

# ---- group: Peça 7
solid_difference = SolidDifference(BrepsA=box_2pt_2, BrepsB=move_65.Geometry)

# ----
move_73 = Move(Geometry=move_72.Geometry, Motion=negative_4)  # -> Geometry, Transform
mirror_7 = Mirror(Geometry=[move_73.Geometry, move_72.Geometry], Plane=xz_plane_3)  # -> Geometry, Transform

# ---- group: Peça 7 Aparência
# 3BF Materializer v0.1
rh_in_10_1_lado_balance = ValueList({"Cara A", "Cara B", "D/D"}, selected="Cara A")
rh_in_10_2_canto_frontal = ValueList({"Canto": 0, "MDP": 1}, selected="Canto")
rh_in_10_3_canto_trasero = ValueList({"Canto": 0, "MDP": 1}, selected="MDP")
rh_in_10_4canto_izquierdo_arriba = ValueList({"Canto": 0, "MDP": 1}, selected="MDP")
rh_in_10_5_canto_derecho_abajo = ValueList({"Canto": 0, "MDP": 1}, selected="MDP")
rh_in_10_0_mapeado = ValueList({"Longitudinal": 1, "Atravesada": 0}, selected="Longitudinal")
python_3_script_31 = Python3Script(
    Brep_In=solid_difference,
    Balance_Mode=rh_in_10_1_lado_balance,
    Canto_1=rh_in_10_2_canto_frontal,
    Canto_2=rh_in_10_3_canto_trasero,
    Canto_3=rh_in_10_4canto_izquierdo_arriba,
    Canto_4=rh_in_10_5_canto_derecho_abajo)  # -> Out, NURBS_Color, NURBS_Balance, NURBS_MDP, Info_Pieza; inputs Brep_In: Brep, Balance_Mode: String, Canto_1: String, Canto_2: String, Canto_3: String, Canto_4: String
# ---------- python_3_script_31: Python ----------
import Rhino

def parse_balance(val):
    s = str(val).lower().strip().replace('"', '').replace("'", "")
    if s in ["6", "d/d", "dyd", "doble", "ninguno", "ambas"] or "d/d" in s or "dyd" in s:
        return "DD"
    if s in ["5", "cara a", "a"] or (s.startswith("a") and len(s) <= 6):
        return "A"
    if s in ["4", "cara b", "b"] or (s.startswith("b") and len(s) <= 6):
        return "B"
    if "ambos" in s:
        return "AMBOS"
    return "B"

def parse_canto(val):
    s = str(val).lower().strip().replace('"', '').replace("'", "")
    if s in ["0", "0.0", "canto", "true", "si", "sí", "con canto"] or ("canto" in s and "sin" not in s):
        return True # Madera / Color
    if s in ["1", "1.0", "mdp", "false", "no", "sin canto"] or "mdp" in s or "sin" in s:
        return False # Crudo / MDP
    return True

def desglosar_pieza_real_nurbs(brep_in, balance_mode="Cara B", c1="Canto", c2="Canto", c3="Canto", c4="Canto"):
    if brep_in is None:
        return [], [], [], "Brep de entrada es nulo"

    # 1. Medir BoundingBox de la envolvente exterior
    bbox = brep_in.GetBoundingBox(True)
    x0, x1 = bbox.Min.X, bbox.Max.X
    y0, y1 = bbox.Min.Y, bbox.Max.Y
    z0, z1 = bbox.Min.Z, bbox.Max.Z

    sx = max(0.1, x1 - x0)
    sy = max(0.1, y1 - y0)
    sz = max(0.1, z1 - z0)
    min_dim = min(sx, sy, sz)

    # Tolerancia geométrica para detectar planos exteriores
    tol = max(0.2, min_dim * 0.15)

    faces_A = []
    faces_B = []
    faces_cantos = {1: [], 2: [], 3: [], 4: []}
    faces_mecanizados = []

    # 2. Clasificar cada cara real de la pieza
    for i in range(brep_in.Faces.Count):
        f = brep_in.Faces[i]
        u = f.Domain(0).Mid
        v = f.Domain(1).Mid
        pt = f.PointAt(u, v)
        n = f.NormalAt(u, v)
        n.Unitize()
        nurbs_face = f.DuplicateFace(False)

        # -------------------------------------------------------------
        # CASO 1: Tablero Horizontal (Cubiertas / Entrepaños - Espesor en Z)
        # -------------------------------------------------------------
        if min_dim == sz:
            tipo_str = "Horizontal (Cubierta)"
            # Cara A (+Z exterior)
            if n.Z > 0.8 and abs(pt.Z - z1) < tol:
                faces_A.append(nurbs_face)
            # Cara B (-Z exterior)
            elif n.Z < -0.8 and abs(pt.Z - z0) < tol:
                faces_B.append(nurbs_face)
            # Canto 1: Frontal (-Y exterior)
            elif n.Y < -0.8 and abs(pt.Y - y0) < tol:
                faces_cantos[1].append(nurbs_face)
            # Canto 2: Trasero (+Y exterior)
            elif n.Y > 0.8 and abs(pt.Y - y1) < tol:
                faces_cantos[2].append(nurbs_face)
            # Canto 3: Izquierdo (-X exterior)
            elif n.X < -0.8 and abs(pt.X - x0) < tol:
                faces_cantos[3].append(nurbs_face)
            # Canto 4: Derecho (+X exterior)
            elif n.X > 0.8 and abs(pt.X - x1) < tol:
                faces_cantos[4].append(nurbs_face)
            else:
                # Perforaciones, brocas, avellanados, cajas minifix
                faces_mecanizados.append(nurbs_face)

        # -------------------------------------------------------------
        # CASO 2: Tablero Vertical Lateral (Costados - Espesor en X)
        # -------------------------------------------------------------
        elif min_dim == sx:
            tipo_str = "Vertical Lateral (Costado)"
            if n.X > 0.8 and abs(pt.X - x1) < tol:
                faces_A.append(nurbs_face)
            elif n.X < -0.8 and abs(pt.X - x0) < tol:
                faces_B.append(nurbs_face)
            elif n.Y < -0.8 and abs(pt.Y - y0) < tol:
                faces_cantos[1].append(nurbs_face) # Frontal
            elif n.Y > 0.8 and abs(pt.Y - y1) < tol:
                faces_cantos[2].append(nurbs_face) # Trasero
            elif n.Z > 0.8 and abs(pt.Z - z1) < tol:
                faces_cantos[3].append(nurbs_face) # Superior
            elif n.Z < -0.8 and abs(pt.Z - z0) < tol:
                faces_cantos[4].append(nurbs_face) # Inferior
            else:
                faces_mecanizados.append(nurbs_face)

        # -------------------------------------------------------------
        # CASO 3: Tablero Vertical Frontal (Frentes / Puertas - Espesor en Y)
        # -------------------------------------------------------------
        else:
            tipo_str = "Vertical Frontal (Frente / Puerta)"
            if n.Y < -0.8 and abs(pt.Y - y0) < tol:
                faces_A.append(nurbs_face)
            elif n.Y > 0.8 and abs(pt.Y - y1) < tol:
                faces_B.append(nurbs_face)
            elif n.Z > 0.8 and abs(pt.Z - z1) < tol:
                faces_cantos[1].append(nurbs_face) # Superior
            elif n.Z < -0.8 and abs(pt.Z - z0) < tol:
                faces_cantos[2].append(nurbs_face) # Inferior
            elif n.X < -0.8 and abs(pt.X - x0) < tol:
                faces_cantos[3].append(nurbs_face) # Izquierdo
            elif n.X > 0.8 and abs(pt.X - x1) < tol:
                faces_cantos[4].append(nurbs_face) # Derecho
            else:
                faces_mecanizados.append(nurbs_face)

    # 3. Asignación de Caras Principales según Balance
    modo_b = parse_balance(balance_mode)
    nurbs_color = []
    nurbs_balance = []
    nurbs_mdp = []

    if modo_b == "DD": # Doble Decorativo (ambas a Color)
        nurbs_color.extend(faces_A)
        nurbs_color.extend(faces_B)
        diag_bal = "D/D (Ambas Caras Madera)"
    elif modo_b == "A": # Balance en Cara A
        nurbs_balance.extend(faces_A)
        nurbs_color.extend(faces_B)
        diag_bal = "Balance Cara A"
    elif modo_b == "B": # Balance en Cara B
        nurbs_color.extend(faces_A)
        nurbs_balance.extend(faces_B)
        diag_bal = "Balance Cara B"
    else:
        nurbs_balance.extend(faces_A)
        nurbs_balance.extend(faces_B)
        diag_bal = "Ambos Balance"

    # 4. Asignación de Cantos (1: Frontal, 2: Trasero, 3: Izquierdo, 4: Derecho)
    cantos_in = {
        1: parse_canto(c1),
        2: parse_canto(c2),
        3: parse_canto(c3),
        4: parse_canto(c4)
    }

    c_color_count = 0
    for num_canto, tiene_canto in cantos_in.items():
        if tiene_canto:
            nurbs_color.extend(faces_cantos[num_canto])
            c_color_count += len(faces_cantos[num_canto])
        else:
            nurbs_mdp.extend(faces_cantos[num_canto])

    # 5. INYECCIÓN CRÍTICA: Todos los Mecanizados van SIEMPRE a MDP
    nurbs_mdp.extend(faces_mecanizados)

    diag = "{0} | {1} | Total Caras: {2} (A={3}, B={4}, Cantos={5}, Mecanizados={6}) | Breps Salida -> Color: {7}, Balance: {8}, MDP: {9}".format(
        tipo_str, diag_bal, brep_in.Faces.Count,
        len(faces_A), len(faces_B), sum(len(v) for v in faces_cantos.values()), len(faces_mecanizados),
        len(nurbs_color), len(nurbs_balance), len(nurbs_mdp)
    )

    return nurbs_color, nurbs_balance, nurbs_mdp, diag


# Ejecución
n_col, n_bal, n_mdp, diag_txt = desglosar_pieza_real_nurbs(
    Brep_In,
    Balance_Mode if 'Balance_Mode' in locals() else "Cara B",
    Canto_1 if 'Canto_1' in locals() else "Canto",
    Canto_2 if 'Canto_2' in locals() else "Canto",
    Canto_3 if 'Canto_3' in locals() else "Canto",
    Canto_4 if 'Canto_4' in locals() else "Canto"
)

# Salidas multinombre
NURBS_Color = n_col
Nurbs_Color = n_col
nurbs_color = n_col
Mesh_Color = n_col

NURBS_Balance = n_bal
Nurbs_Balance = n_bal
nurbs_balance = n_bal
Mesh_Balance = n_bal

NURBS_MDP = n_mdp
Nurbs_MDP = n_mdp
nurbs_mdp = n_mdp
Mesh_MDP = n_mdp

Info_Pieza = diag_txt
info_pieza = diag_txt
# ---------- end python_3_script_31 ----------
mesh_brep_15 = MeshBrep(
    Brep=python_3_script_31.NURBS_Color,
    Settings={GridMaxCount=0, GridMinCount=16, JaggedSeams=False, MaxEdgeLength=0, MinEdgeLength=0.0001, MinTolerance=0, Refine=True, RefineAngle=0, RelativeTolerance=0.65, SimplePlanes=True, Tolerance=0})
mesh_brep_16 = MeshBrep(
    Brep=python_3_script_31.NURBS_Balance,
    Settings={GridMaxCount=0, GridMinCount=16, JaggedSeams=False, MaxEdgeLength=0, MinEdgeLength=0.0001, MinTolerance=0, Refine=True, RefineAngle=0, RelativeTolerance=0.65, SimplePlanes=True, Tolerance=0})
mesh_brep_17 = MeshBrep(
    Brep=python_3_script_31.NURBS_MDP,
    Settings={GridMaxCount=0, GridMinCount=16, JaggedSeams=False, MaxEdgeLength=0, MinEdgeLength=0.0001, MinTolerance=0, Refine=True, RefineAngle=0, RelativeTolerance=0.65, SimplePlanes=True, Tolerance=0})
diagnostico_17 = Panel(python_3_script_31.Info_Pieza)
mesh_join_15 = MeshJoin(Meshes=flatten(mesh_brep_15))
mesh_join_16 = MeshJoin(Meshes=flatten(mesh_brep_16))
mesh_join_17 = MeshJoin(Meshes=flatten(mesh_brep_17))
python_3_script_32 = Python3Script(M=mesh_join_15, B=rh_in_10_0_mapeado)  # -> a; inputs M: Mesh, B: Int32
# ---------- python_3_script_32: Python ----------
import Rhino

def aplicar_box_mapping_profesional(mesh_in, modo_veta=0, escala_caja_mm=600.0):
    if mesh_in is None:
        return None
        
    mesh = mesh_in.DuplicateMesh() if hasattr(mesh_in, "DuplicateMesh") else mesh_in
    if not isinstance(mesh, Rhino.Geometry.Mesh):
        return mesh_in

    # 1. Desoldar aristas vivas para separar las 6 caras
    mesh.Unweld(0.0, True)
    mesh.Normals.ComputeNormals()
    mesh.TextureCoordinates.Clear()

    # 2. Medir BoundingBox real de la pieza en mm
    bbox = mesh.GetBoundingBox(True)
    sx = max(1.0, bbox.Max.X - bbox.Min.X)
    sy = max(1.0, bbox.Max.Y - bbox.Min.Y)
    sz = max(1.0, bbox.Max.Z - bbox.Min.Z)

    # Identificar el espesor (menor dimensión, ej: 15 mm)
    min_dim = min(sx, sy, sz)

    # 3. Detectar si la cara principal es Atravesada (1) o Longitudinal (0)
    es_atravesada = False
    if isinstance(modo_veta, str):
        es_atravesada = "atravesad" in modo_veta.lower() or modo_veta in ["1", "3", "5"]
    elif isinstance(modo_veta, (int, float)):
        es_atravesada = int(modo_veta) in [1, 3, 5]

    escala = float(escala_caja_mm)

    # 4. Asignar UVs: Las caras rotan con el selector, los 4 cantos SIEMPRE corren a lo largo del borde
    for idx in range(mesh.Vertices.Count):
        v = mesh.Vertices[idx]
        n = mesh.Normals[idx] if idx < mesh.Normals.Count else Rhino.Geometry.Vector3f(0, 0, 1)
        
        lx = v.X - bbox.Min.X
        ly = v.Y - bbox.Min.Y
        lz = v.Z - bbox.Min.Z
        
        nx, ny, nz = abs(n.X), abs(n.Y), abs(n.Z)

        # -------------------------------------------------------------
        # CASO 1: Tablero Horizontal (Cubiertas, Entrepaños - Espesor en Z)
        # -------------------------------------------------------------
        if min_dim == sz:
            if nz >= nx and nz >= ny:
                # Caras Principales (Superior / Inferior) -> Responde a Longitudinal / Atravesada
                u = ly / escala if es_atravesada else lx / escala
                v_coord = lx / escala if es_atravesada else ly / escala
            elif ny >= nx and ny >= nz:
                # Canto Frontal / Trasero -> Veta corre a lo largo del ancho X
                u = lx / escala
                v_coord = lz / escala
            else:
                # Canto Lateral Izq / Der -> Veta corre a lo largo de la profundidad Y
                u = ly / escala
                v_coord = lz / escala

        # -------------------------------------------------------------
        # CASO 2: Tablero Vertical Lateral (Costados, Laterales - Espesor en X)
        # -------------------------------------------------------------
        elif min_dim == sx:
            if nx >= ny and nx >= nz:
                # Caras Principales (Caras exteriores e interiores)
                u = lz / escala if es_atravesada else ly / escala
                v_coord = ly / escala if es_atravesada else lz / escala
            elif ny >= nx and ny >= nz:
                # Canto Frontal / Trasero -> Veta corre a lo largo de la altura Z
                u = lz / escala
                v_coord = lx / escala
            else:
                # Canto Superior / Inferior -> Veta corre a lo largo de la profundidad Y
                u = ly / escala
                v_coord = lx / escala

        # -------------------------------------------------------------
        # CASO 3: Tablero Vertical Frontal (Frentes de Cajón, Tapa Luz, Puertas - Espesor en Y)
        # -------------------------------------------------------------
        else:
            if ny >= nx and ny >= nz:
                # Caras Principales (Frente y Trasera) -> Responde a Longitudinal / Atravesada
                u = lz / escala if es_atravesada else lx / escala
                v_coord = lx / escala if es_atravesada else lz / escala
            elif nz >= nx and nz >= ny:
                # Canto Superior / Inferior -> Veta corre a lo largo del ancho X
                u = lx / escala
                v_coord = ly / escala
            else:
                # Canto Lateral Izq / Der -> Veta corre a lo largo de la altura Z
                u = lz / escala
                v_coord = ly / escala

        mesh.TextureCoordinates.Add(float(u), float(v_coord))
        
    return mesh


if isinstance(M, list):
    resultado = [aplicar_box_mapping_profesional(item, B, 600.0) for item in M if item is not None]
else:
    resultado = aplicar_box_mapping_profesional(M, B, 600.0)

a = resultado
# ---------- end python_3_script_32 ----------
python_3_script_33 = Python3Script(M=mesh_join_16, B=rh_in_10_0_mapeado)  # -> a; inputs M: Mesh, B: Int32; same code as python_3_script_32
python_3_script_34 = Python3Script(M=mesh_join_17, B=rh_in_10_0_mapeado)  # -> a; inputs M: Mesh, B: Int32; same code as python_3_script_32
rh_out_mdp_peça_7 = Geometry(python_3_script_34)
rh_out_peça_7_b = Geometry(python_3_script_33)
# Posicionador Borde Superior
# Posicionador Borde Inferior
rh_out_peça_7 = Geometry(python_3_script_32)

# ---- group: Ranuras Laterales (continued)
deconstruct_brep_20 = DeconstructBrep(Brep=box_2pt_15)  # -> Faces, Edges, Vertices
deconstruct_brep_21 = DeconstructBrep(Brep=box_2pt_15)  # -> Faces, Edges, Vertices
list_item_35 = ListItem(List=deconstruct_brep_21.Vertices, Index="3", Wrap=True)
list_item_36 = ListItem(List=deconstruct_brep_20.Vertices, Index="0", Wrap=True)
move_74 = Move(Geometry=list_item_36, Motion=unit_z_25)  # -> Geometry, Transform
move_75 = Move(Geometry=move_74.Geometry, Motion=unit_x_16)  # -> Geometry, Transform
mirror_8 = Mirror(Geometry=move_75.Geometry, Plane=yz_plane_3)  # -> Geometry, Transform

# ----
deconstruct_brep_22 = DeconstructBrep(Brep=stream_filter_4)  # -> Faces, Edges, Vertices
list_item_37 = ListItem(List=deconstruct_brep_22.Vertices, Index=panel_11, Wrap=True)
move_76 = Move(Geometry=list_item_37, Motion=unit_y_31)  # -> Geometry, Transform
deconstruct_brep_23 = DeconstructBrep(Brep=stream_filter_4)  # -> Faces, Edges, Vertices
list_item_38 = ListItem(List=deconstruct_brep_23.Vertices, Index="3", Wrap=True)
move_77 = Move(Geometry=list_item_37, Motion=unit_z_28)  # -> Geometry, Transform
list_item_39 = ListItem(List=deconstruct_brep_23.Vertices, Index="2", Wrap=True)
move_78 = Move(Geometry=list_item_38, Motion=unit_z_29)  # -> Geometry, Transform
move_79 = Move(Geometry=list_item_39, Motion=unit_z_30)  # -> Geometry, Transform
line_4 = Line(StartPoint=list_item_37, EndPoint=move_76.Geometry)
line_5 = Line(StartPoint=move_77.Geometry, EndPoint=list_item_37)
line_6 = Line(StartPoint=move_77.Geometry, EndPoint=move_76.Geometry)
line_7 = Line(StartPoint=list_item_37, EndPoint=move_76.Geometry)
line_8 = Line(StartPoint=move_77.Geometry, EndPoint=list_item_37)
line_9 = Line(StartPoint=move_77.Geometry, EndPoint=move_76.Geometry)
move_80 = Move(Geometry=move_78.Geometry, Motion=unit_x_18)  # -> Geometry, Transform
line_10 = Line(StartPoint=move_53.Geometry, EndPoint=move_54.Geometry)
line_11 = Line(StartPoint=move_45.Geometry, EndPoint=move_46.Geometry)
move_81 = Move(Geometry=move_79.Geometry, Motion=unit_x_19)  # -> Geometry, Transform
join_curves = JoinCurves(Curves=[line_4, line_5, line_6], Preserve=False)
join_curves_2 = JoinCurves(Curves=[line_7, line_8, line_9], Preserve=False)
length_4 = Length(Curve=line_10)
length_5 = Length(Curve=line_11)
unit_x_20 = UnitX(Factor=length_4)
unit_x_21 = UnitX(Factor=length_5)
move_82 = Move(Geometry=move_81.Geometry, Motion=unit_y_32)  # -> Geometry, Transform
extrude = Extrude(Base=join_curves, Direction=unit_x_20)
extrude_2 = Extrude(Base=join_curves_2, Direction=unit_x_21)
stream_filter_7 = StreamFilter(Gate=expression_2, Stream1=extrude, Stream2=extrude_2)
vector_2pt_8 = Vector2Pt(PointA=list_item_27, PointB=list_item_25, Unitize=False)  # -> Vector, Length

# ---- group: Operaciones Frente Cajon
box_2pt_16 = Box2Pt(PointA=move_80.Geometry, PointB=move_82.Geometry, Plane=PlaneXY(0, 0, 0))
cap_holes_2 = CapHoles(Brep=stream_filter_7)
brep_5 = Brep([mirror_6.Geometry, move_64.Geometry, cap_holes])

# ---- group: Frente
solid_difference_2 = SolidDifference(BrepsA=stream_filter_4, BrepsB=flatten([cap_holes_2, box_2pt_16, brep_5]))

# ----
move_83 = Move(Geometry=solid_difference_2, Motion=vector_2pt_8.Vector)  # -> Geometry, Transform
stream_filter_8 = StreamFilter(Gate=expression_2, Stream1=solid_difference_2, Stream2=[solid_difference_2, move_83.Geometry])

move_84 = Move(Geometry=stream_filter_8, Motion=unit_y)  # -> Geometry, Transform

# ---- group: Peça 19 Aparência
# 3BF Materializer v0.2
# 3BF Box Mapping  v1.0
rh_in_22_1_lado_balance = ValueList({"Cara A", "Cara B", "D/D"}, selected="Cara B")
rh_in_22_2_canto_frontal = ValueList({"Canto": 0, "MDP": 1}, selected="Canto")
rh_in_22_3_canto_trasero = ValueList({"Canto": 0, "MDP": 1}, selected="Canto")
rh_in_22_4canto_izquierdo_arriba = ValueList({"Canto": 0, "MDP": 1}, selected="Canto")
rh_in_22_5_canto_derecho_abajo = ValueList({"Canto": 0, "MDP": 1}, selected="Canto")
rh_in_22_0_mapeado = ValueList({"Longitudinal": 0, "Atravesada": 1}, selected="Longitudinal")
python_3_script_35 = Python3Script(
    Brep_In=move_84.Geometry,
    Balance_Mode=rh_in_22_1_lado_balance,
    Canto_1=rh_in_22_2_canto_frontal,
    Canto_2=rh_in_22_3_canto_trasero,
    Canto_3=rh_in_22_4canto_izquierdo_arriba,
    Canto_4=rh_in_22_5_canto_derecho_abajo)  # -> Out, NURBS_Color, NURBS_Balance, NURBS_MDP, Info_Pieza; inputs Brep_In: Brep, Balance_Mode: String, Canto_1: String, Canto_2: String, Canto_3: String, Canto_4: String
# ---------- python_3_script_35: Python ----------
"""
3BF Materializer v0.2
Motor DfMA de Desglose de Caras Paramétricas para Manufactura Digital
Soporta: Caras Planas Ortogonales, Chaflanes/Biseles a 45° (Tiradores Integrados) y Mecanizados CNC
Autor: Mario Mojica & Antigravity
"""

import Rhino

def parse_balance(val):
    s = str(val).lower().strip().replace('"', '').replace("'", "")
    if s in ["6", "d/d", "dyd", "doble", "ninguno", "ambas"] or "d/d" in s or "dyd" in s:
        return "DD"
    if s in ["5", "cara a", "a"] or (s.startswith("a") and len(s) <= 6):
        return "A"
    if s in ["4", "cara b", "b"] or (s.startswith("b") and len(s) <= 6):
        return "B"
    if "ambos" in s:
        return "AMBOS"
    return "B"

def parse_canto(val):
    s = str(val).lower().strip().replace('"', '').replace("'", "")
    if s in ["0", "0.0", "canto", "true", "si", "sí", "con canto"] or ("canto" in s and "sin" not in s):
        return True # Madera / Color
    if s in ["1", "1.0", "mdp", "false", "no", "sin canto"] or "mdp" in s or "sin" in s:
        return False # Crudo / MDP
    return True

def desglosar_pieza_real_nurbs(brep_in, balance_mode="Cara B", c1="Canto", c2="Canto", c3="Canto", c4="Canto"):
    if brep_in is None:
        return [], [], [], "Brep de entrada es nulo"

    # 1. Medir BoundingBox de la envolvente exterior
    bbox = brep_in.GetBoundingBox(True)
    x0, x1 = bbox.Min.X, bbox.Max.X
    y0, y1 = bbox.Min.Y, bbox.Max.Y
    z0, z1 = bbox.Min.Z, bbox.Max.Z

    sx = max(0.1, x1 - x0)
    sy = max(0.1, y1 - y0)
    sz = max(0.1, z1 - z0)
    min_dim = min(sx, sy, sz)

    # Tolerancia para planos principales y zona de influencia de biseles/chaflanes
    tol = max(0.2, min_dim * 0.15)
    zona_bisel = max(tol * 2.5, min_dim * 2.5)

    faces_A = []
    faces_B = []
    faces_cantos = {1: [], 2: [], 3: [], 4: []}
    faces_mecanizados = []

    # 2. Clasificar cada cara real de la pieza
    for i in range(brep_in.Faces.Count):
        f = brep_in.Faces[i]
        u = (f.Domain(0).T0 + f.Domain(0).T1) * 0.5
        v = (f.Domain(1).T0 + f.Domain(1).T1) * 0.5
        pt = f.PointAt(u, v)
        n = f.NormalAt(u, v)
        n.Unitize()
        nurbs_face = f.DuplicateFace(False)

        # -------------------------------------------------------------
        # CASO 1: Tablero Horizontal (Cubiertas / Entrepaños - Espesor en Z)
        # -------------------------------------------------------------
        if min_dim == sz:
            tipo_str = "Horizontal (Cubierta/Entrepaño)"
            # Cara A (+Z exterior)
            if n.Z > 0.85 and abs(pt.Z - z1) < tol:
                faces_A.append(nurbs_face)
            # Cara B (-Z exterior)
            elif n.Z < -0.85 and abs(pt.Z - z0) < tol:
                faces_B.append(nurbs_face)
            # Canto 1: Frontal (-Y exterior, plano o chaflán)
            elif n.Y < -0.20 and (pt.Y - y0) < zona_bisel:
                faces_cantos[1].append(nurbs_face)
            # Canto 2: Trasero (+Y exterior, plano o chaflán)
            elif n.Y > 0.20 and (y1 - pt.Y) < zona_bisel:
                faces_cantos[2].append(nurbs_face)
            # Canto 3: Izquierdo (-X exterior, plano o chaflán)
            elif n.X < -0.20 and (pt.X - x0) < zona_bisel:
                faces_cantos[3].append(nurbs_face)
            # Canto 4: Derecho (+X exterior, plano o chaflán)
            elif n.X > 0.20 and (x1 - pt.X) < zona_bisel:
                faces_cantos[4].append(nurbs_face)
            else:
                faces_mecanizados.append(nurbs_face)

        # -------------------------------------------------------------
        # CASO 2: Tablero Vertical Lateral (Costados / Parales - Espesor en X)
        # -------------------------------------------------------------
        elif min_dim == sx:
            tipo_str = "Vertical Lateral (Costado/Paral)"
            # Cara A (+X exterior)
            if n.X > 0.85 and abs(pt.X - x1) < tol:
                faces_A.append(nurbs_face)
            # Cara B (-X exterior)
            elif n.X < -0.85 and abs(pt.X - x0) < tol:
                faces_B.append(nurbs_face)
            # Canto 1: Frontal (-Y exterior, plano o chaflán)
            elif n.Y < -0.20 and (pt.Y - y0) < zona_bisel:
                faces_cantos[1].append(nurbs_face)
            # Canto 2: Trasero (+Y exterior, plano o chaflán)
            elif n.Y > 0.20 and (y1 - pt.Y) < zona_bisel:
                faces_cantos[2].append(nurbs_face)
            # Canto 3: Superior (+Z exterior, plano o chaflán)
            elif n.Z > 0.20 and (z1 - pt.Z) < zona_bisel:
                faces_cantos[3].append(nurbs_face)
            # Canto 4: Inferior (-Z exterior, plano o chaflán)
            elif n.Z < -0.20 and (pt.Z - z0) < zona_bisel:
                faces_cantos[4].append(nurbs_face)
            else:
                faces_mecanizados.append(nurbs_face)

        # -------------------------------------------------------------
        # CASO 3: Tablero Vertical Frontal (Frentes / Puertas - Espesor en Y)
        # -------------------------------------------------------------
        else:
            tipo_str = "Vertical Frontal (Frente / Puerta)"
            # Cara A Frontal Delantera (-Y exterior visible)
            if n.Y < -0.85 and abs(pt.Y - y0) < tol:
                faces_A.append(nurbs_face)
            # Cara B Trasera (+Y interior)
            elif n.Y > 0.85 and abs(pt.Y - y1) < tol:
                faces_B.append(nurbs_face)
            # Canto 1: Superior (Plano Y Bisel/Tirador Diagonal a 45° en la zona alta)
            elif n.Z > 0.20 and (z1 - pt.Z) < zona_bisel:
                faces_cantos[1].append(nurbs_face)
            # Canto 2: Inferior (Plano o Bisel en la zona baja)
            elif n.Z < -0.20 and (pt.Z - z0) < zona_bisel:
                faces_cantos[2].append(nurbs_face)
            # Canto 3: Izquierdo (Plano o Bisel en lateral izquierdo)
            elif n.X < -0.20 and (pt.X - x0) < zona_bisel:
                faces_cantos[3].append(nurbs_face)
            # Canto 4: Derecho (Plano o Bisel en lateral derecho)
            elif n.X > 0.20 and (x1 - pt.X) < zona_bisel:
                faces_cantos[4].append(nurbs_face)
            else:
                # Perforaciones cilíndricas, cajas de minifix y ranuras de fondo
                faces_mecanizados.append(nurbs_face)

    # 3. Asignación de Caras Principales según Balance
    modo_b = parse_balance(balance_mode)
    nurbs_color = []
    nurbs_balance = []
    nurbs_mdp = []

    if modo_b == "DD": # Doble Decorativo (ambas a Color)
        nurbs_color.extend(faces_A)
        nurbs_color.extend(faces_B)
        diag_bal = "D/D (Ambas Caras Madera)"
    elif modo_b == "A": # Balance en Cara A
        nurbs_balance.extend(faces_A)
        nurbs_color.extend(faces_B)
        diag_bal = "Balance Cara A"
    elif modo_b == "B": # Balance en Cara B
        nurbs_color.extend(faces_A)
        nurbs_balance.extend(faces_B)
        diag_bal = "Balance Cara B"
    else:
        nurbs_balance.extend(faces_A)
        nurbs_balance.extend(faces_B)
        diag_bal = "Ambos Balance"

    # 4. Asignación de Cantos (1: Canto 1, 2: Canto 2, 3: Canto 3, 4: Canto 4)
    cantos_in = {
        1: parse_canto(c1),
        2: parse_canto(c2),
        3: parse_canto(c3),
        4: parse_canto(c4)
    }

    c_color_count = 0
    for num_canto, tiene_canto in cantos_in.items():
        if tiene_canto:
            nurbs_color.extend(faces_cantos[num_canto])
            c_color_count += len(faces_cantos[num_canto])
        else:
            nurbs_mdp.extend(faces_cantos[num_canto])

    # 5. INYECCIÓN DfMA: Mecanizados internos (taladros, ranuras) van SIEMPRE a MDP
    nurbs_mdp.extend(faces_mecanizados)

    diag = "{0} | {1} | Total Caras: {2} (A={3}, B={4}, Cantos={5}, Mecanizados={6}) | Breps Salida -> Color: {7}, Balance: {8}, MDP: {9}".format(
        tipo_str, diag_bal, brep_in.Faces.Count,
        len(faces_A), len(faces_B), sum(len(v) for v in faces_cantos.values()), len(faces_mecanizados),
        len(nurbs_color), len(nurbs_balance), len(nurbs_mdp)
    )

    return nurbs_color, nurbs_balance, nurbs_mdp, diag


# Ejecución
n_col, n_bal, n_mdp, diag_txt = desglosar_pieza_real_nurbs(
    Brep_In,
    Balance_Mode if 'Balance_Mode' in locals() else "Cara B",
    Canto_1 if 'Canto_1' in locals() else "Canto",
    Canto_2 if 'Canto_2' in locals() else "Canto",
    Canto_3 if 'Canto_3' in locals() else "Canto",
    Canto_4 if 'Canto_4' in locals() else "Canto"
)

# Salidas multinombre
NURBS_Color = n_col
Nurbs_Color = n_col
nurbs_color = n_col
Mesh_Color = n_col

NURBS_Balance = n_bal
Nurbs_Balance = n_bal
nurbs_balance = n_bal
Mesh_Balance = n_bal

NURBS_MDP = n_mdp
Nurbs_MDP = n_mdp
nurbs_mdp = n_mdp
Mesh_MDP = n_mdp

Info_Pieza = diag_txt
# ---------- end python_3_script_35 ----------
diagnostico_18 = Panel(python_3_script_35.Info_Pieza)
split_tree = SplitTree(Data=python_3_script_35.NURBS_Balance, Masks=flatten("{*;0}"))  # -> Positive, Negative
split_tree_2 = SplitTree(Data=python_3_script_35.NURBS_Color, Masks=flatten("{*;0}"))  # -> Positive, Negative
split_tree_3 = SplitTree(Data=python_3_script_35.NURBS_MDP, Masks=flatten("{*;0}"))  # -> Positive, Negative
mesh_brep_18 = MeshBrep(
    Brep=split_tree_2.Positive,
    Settings={GridMaxCount=0, GridMinCount=16, JaggedSeams=False, MaxEdgeLength=0, MinEdgeLength=0.0001, MinTolerance=0, Refine=True, RefineAngle=0, RelativeTolerance=0.65, SimplePlanes=True, Tolerance=0})
mesh_brep_19 = MeshBrep(
    Brep=split_tree_2.Negative,
    Settings={GridMaxCount=0, GridMinCount=16, JaggedSeams=False, MaxEdgeLength=0, MinEdgeLength=0.0001, MinTolerance=0, Refine=True, RefineAngle=0, RelativeTolerance=0.65, SimplePlanes=True, Tolerance=0})
mesh_brep_20 = MeshBrep(
    Brep=split_tree.Positive,
    Settings={GridMaxCount=0, GridMinCount=16, JaggedSeams=False, MaxEdgeLength=0, MinEdgeLength=0.0001, MinTolerance=0, Refine=True, RefineAngle=0, RelativeTolerance=0.65, SimplePlanes=True, Tolerance=0})
mesh_brep_21 = MeshBrep(
    Brep=split_tree.Negative,
    Settings={GridMaxCount=0, GridMinCount=16, JaggedSeams=False, MaxEdgeLength=0, MinEdgeLength=0.0001, MinTolerance=0, Refine=True, RefineAngle=0, RelativeTolerance=0.65, SimplePlanes=True, Tolerance=0})
mesh_brep_22 = MeshBrep(
    Brep=split_tree_3.Positive,
    Settings={GridMaxCount=0, GridMinCount=16, JaggedSeams=False, MaxEdgeLength=0, MinEdgeLength=0.0001, MinTolerance=0, Refine=True, RefineAngle=0, RelativeTolerance=0.65, SimplePlanes=True, Tolerance=0})
mesh_brep_23 = MeshBrep(
    Brep=split_tree_3.Negative,
    Settings={GridMaxCount=0, GridMinCount=16, JaggedSeams=False, MaxEdgeLength=0, MinEdgeLength=0.0001, MinTolerance=0, Refine=True, RefineAngle=0, RelativeTolerance=0.65, SimplePlanes=True, Tolerance=0})
mesh_join_18 = MeshJoin(Meshes=flatten(mesh_brep_18))
mesh_join_19 = MeshJoin(Meshes=flatten(mesh_brep_19))
mesh_join_20 = MeshJoin(Meshes=flatten(mesh_brep_20))
mesh_join_21 = MeshJoin(Meshes=flatten(mesh_brep_21))
mesh_join_22 = MeshJoin(Meshes=flatten(mesh_brep_22))
mesh_join_23 = MeshJoin(Meshes=flatten(mesh_brep_23))
python_3_script_36 = Python3Script(M=mesh_join_18, B=rh_in_22_0_mapeado)  # -> a; inputs M: Mesh, B: Int32; same code as python_3_script_2
python_3_script_37 = Python3Script(M=mesh_join_19, B=rh_in_22_0_mapeado)  # -> a; inputs M: Mesh, B: Int32; same code as python_3_script_2
python_3_script_38 = Python3Script(M=mesh_join_20, B=rh_in_22_0_mapeado)  # -> a; inputs M: Mesh, B: Int32; same code as python_3_script_2
python_3_script_39 = Python3Script(M=mesh_join_21, B=rh_in_22_0_mapeado)  # -> a; inputs M: Mesh, B: Int32; same code as python_3_script_2
python_3_script_40 = Python3Script(M=mesh_join_22, B=rh_in_22_0_mapeado)  # -> a; inputs M: Mesh, B: Int32; same code as python_3_script_2
python_3_script_41 = Python3Script(M=mesh_join_23, B=rh_in_22_0_mapeado)  # -> a; inputs M: Mesh, B: Int32; same code as python_3_script_2
linear_array_3 = LinearArray(Geometry=[python_3_script_40, python_3_script_41], Direction=negative, Count=cantidad_cajones)  # -> Geometry, Transform
linear_array_4 = LinearArray(Geometry=[python_3_script_38, python_3_script_39], Direction=negative, Count=cantidad_cajones)  # -> Geometry, Transform
linear_array_5 = LinearArray(Geometry=[python_3_script_36, python_3_script_37], Direction=negative, Count=cantidad_cajones)  # -> Geometry, Transform
rh_out_peça_19_b = Geometry(linear_array_4.Geometry)
rh_out_mdp_peça_19 = Geometry(linear_array_3.Geometry)
rh_out_peça_19 = Geometry(linear_array_5.Geometry)

# ----
move_85 = Move(Geometry=list_item_36, Motion=unit_z_26)  # -> Geometry, Transform
move_86 = Move(Geometry=move_85.Geometry, Motion=unit_z_27)  # -> Geometry, Transform
move_87 = Move(Geometry=move_86.Geometry, Motion=unit_x_17)  # -> Geometry, Transform
move_88 = Move(Geometry=move_86.Geometry, Motion=unit_y_30)  # -> Geometry, Transform
mirror_9 = Mirror(Geometry=move_88.Geometry, Plane=yz_plane_3)  # -> Geometry, Transform
vector_2pt_9 = Vector2Pt(PointA=list_item_27, PointB=list_item_25, Unitize=False)  # -> Vector, Length

# ----
# Posterior de Cajon
deconstruct_brep_24 = DeconstructBrep(Brep=box_2pt_15)  # -> Faces, Edges, Vertices
list_item_40 = ListItem(List=deconstruct_brep_24.Vertices, Index="7", Wrap=True)
mirror_10 = Mirror(Geometry=list_item_35, Plane=yz_plane_3)  # -> Geometry, Transform
unit_y_33 = UnitY(Factor="12")
move_89 = Move(Geometry=list_item_40, Motion=unit_y_33)  # -> Geometry, Transform
box_2pt_17 = Box2Pt(PointA=move_89.Geometry, PointB=mirror_10.Geometry, Plane=PlaneXY(0, 0, 0))
area_4 = Area(Geometry=box_2pt_17)  # -> Area, Centroid
yz_plane_4 = YZPlane(Origin=area_4.Centroid)
deconstruct_brep_25 = DeconstructBrep(Brep=box_2pt_17)  # -> Faces, Edges, Vertices
deconstruct_brep_26 = DeconstructBrep(Brep=box_2pt_17)  # -> Faces, Edges, Vertices
list_item_41 = ListItem(List=deconstruct_brep_26.Vertices, Index="0", Wrap=True)
unit_z_33 = UnitZ(Factor="12.5")
list_item_42 = ListItem(List=deconstruct_brep_25.Vertices, Index="1", Wrap=True)
move_90 = Move(Geometry=list_item_42, Motion=unit_z)  # -> Geometry, Transform
move_91 = Move(Geometry=list_item_41, Motion=unit_z_33)  # -> Geometry, Transform
move_92 = Move(Geometry=move_90.Geometry, Motion=unit_y_2)  # -> Geometry, Transform
mirror_11 = Mirror(Geometry=brep_5, Plane=yz_plane_3)  # -> Geometry, Transform
box_2pt_18 = Box2Pt(PointA=move_91.Geometry, PointB=move_92.Geometry, Plane=PlaneXY(0, 0, 0))
vector_2pt_10 = Vector2Pt(PointA=list_item_27, PointB=list_item_25, Unitize=False)  # -> Vector, Length

# ---- group: Ranuras Laterales (continued)
unit_z_34 = UnitZ(Factor="12.5")
move_93 = Move(Geometry=list_item_35, Motion=unit_z_34)  # -> Geometry, Transform
move_94 = Move(Geometry=move_93.Geometry, Motion=unit_x_15)  # -> Geometry, Transform
box_2pt_19 = Box2Pt(PointA=move_94.Geometry, PointB=mirror_8.Geometry, Plane=PlaneXY(0, 0, 0))

# ---- group: Lateral de cajon IZQ
solid_difference_3 = SolidDifference(BrepsA=box_2pt_15, BrepsB=flatten([brep_5, box_2pt_19]))

# ---- group: Lateral de cajon Der
mirror_12 = Mirror(Geometry=solid_difference_3, Plane=yz_plane_3)  # -> Geometry, Transform

# ----
move_95 = Move(Geometry=[solid_difference_3, mirror_12.Geometry], Motion=vector_2pt_3.Vector)  # -> Geometry, Transform
stream_filter_9 = StreamFilter(
    Gate=expression_2,
    Stream1=[solid_difference_3, mirror_12.Geometry],
    Stream2=[move_95.Geometry, solid_difference_3, mirror_12.Geometry])

# ---- group: Peça 17 Aparência
# 3BF Materializer v0.3
# 3BF Box Mapping v1.0
# 3BF Mesh Channel Separator v2.2
rh_in_20_0_mapeado = ValueList({"Longitudinal": 0, "Atravesada": 1}, selected="Longitudinal")
python_3_script_42 = Python3Script(Brep_In=stream_filter_9)  # -> out, Pieza_1, Pieza_2, Pieza_3, Pieza_4; inputs Brep_In: list of Brep; same code as python_3_script
diagnostico_19 = Panel(python_3_script_42.out)
mesh_brep_24 = MeshBrep(
    Brep=python_3_script_42.Pieza_1,
    Settings={GridMaxCount=0, GridMinCount=16, JaggedSeams=False, MaxEdgeLength=0, MinEdgeLength=0.0001, MinTolerance=0, Refine=True, RefineAngle=0, RelativeTolerance=0.65, SimplePlanes=True, Tolerance=0})
mesh_brep_25 = MeshBrep(
    Brep=python_3_script_42.Pieza_2,
    Settings={GridMaxCount=0, GridMinCount=16, JaggedSeams=False, MaxEdgeLength=0, MinEdgeLength=0.0001, MinTolerance=0, Refine=True, RefineAngle=0, RelativeTolerance=0.65, SimplePlanes=True, Tolerance=0})
mesh_brep_26 = MeshBrep(
    Brep=python_3_script_42.Pieza_3,
    Settings={GridMaxCount=0, GridMinCount=16, JaggedSeams=False, MaxEdgeLength=0, MinEdgeLength=0.0001, MinTolerance=0, Refine=True, RefineAngle=0, RelativeTolerance=0.65, SimplePlanes=True, Tolerance=0})
mesh_brep_27 = MeshBrep(
    Brep=python_3_script_42.Pieza_4,
    Settings={GridMaxCount=0, GridMinCount=16, JaggedSeams=False, MaxEdgeLength=0, MinEdgeLength=0.0001, MinTolerance=0, Refine=True, RefineAngle=0, RelativeTolerance=0.65, SimplePlanes=True, Tolerance=0})
rh_in_20_1_lado_balance = ValueList({"Cara A", "Cara B", "D/D"}, selected="Cara B")
rh_in_20_2_canto_frontal = ValueList({"Canto": 0, "MDP": 1}, selected="MDP")
rh_in_20_3_canto_trasero = ValueList({"Canto": 0, "MDP": 1}, selected="MDP")
rh_in_20_4_canto_izquierdo_arriba = ValueList({"Canto": 0, "MDP": 1}, selected="Canto")
rh_in_20_5_canto_derecho_abajo = ValueList({"Canto": 0, "MDP": 1}, selected="MDP")
mesh_join_24 = MeshJoin(Meshes=flatten(mesh_brep_24))
mesh_join_25 = MeshJoin(Meshes=flatten(mesh_brep_25))
mesh_join_26 = MeshJoin(Meshes=flatten(mesh_brep_26))
mesh_join_27 = MeshJoin(Meshes=flatten(mesh_brep_27))
python_3_script_43 = Python3Script(M=mesh_join_24, B=rh_in_20_0_mapeado)  # -> a; inputs M: Mesh, B: Int32; same code as python_3_script_2
python_3_script_44 = Python3Script(M=mesh_join_25, B=rh_in_20_0_mapeado)  # -> a; inputs M: Mesh, B: Int32; same code as python_3_script_2
python_3_script_45 = Python3Script(M=mesh_join_26, B=rh_in_20_0_mapeado)  # -> a; inputs M: Mesh, B: Int32; same code as python_3_script_2
python_3_script_46 = Python3Script(M=mesh_join_27, B=rh_in_20_0_mapeado)  # -> a; inputs M: Mesh, B: Int32; same code as python_3_script_2
linear_array_6 = LinearArray(
    Geometry=[python_3_script_43, python_3_script_44, python_3_script_45, python_3_script_46],
    Direction=negative,
    Count=cantidad_cajones)  # -> Geometry, Transform
python_3_script_47 = Python3Script(
    M_In=linear_array_6.Geometry,
    Balance_Mode=rh_in_20_1_lado_balance,
    Canto_1=rh_in_20_2_canto_frontal,
    Canto_2=rh_in_20_3_canto_trasero,
    Canto_3=rh_in_20_4_canto_izquierdo_arriba,
    Canto_4=rh_in_20_5_canto_derecho_abajo)  # -> out, Color, Balance, MDP; inputs M_In: list; same code as python_3_script_3
diagnostico_20 = Panel(python_3_script_47.out)
rh_out_mdp_peça_17 = Geometry(python_3_script_47.MDP)
rh_out_peça_17_b = Geometry(python_3_script_47.Balance)
rh_out_peça_17 = Geometry(python_3_script_47.Color)

# ---- group: Posterior
solid_difference_4 = SolidDifference(BrepsA=box_2pt_17, BrepsB=flatten([brep_5, box_2pt_18, mirror_11.Geometry]))

# ----
move_96 = Move(Geometry=solid_difference_4, Motion=vector_2pt_10.Vector)  # -> Geometry, Transform
stream_filter_10 = StreamFilter(Gate=expression_2, Stream1=solid_difference_4, Stream2=[move_96.Geometry, solid_difference_4])

# ---- group: Peça 16 Aparência
# 3BF Materializer v0.2.1
# 3BF Box Mapping v0.4
rh_in_19_1_lado_balance = ValueList({"Cara A", "Cara B", "D/D"}, selected="Cara A")
rh_in_19_2_canto_frontal = ValueList({"Canto": 0, "MDP": 1}, selected="MDP")
rh_in_19_3_canto_trasero = ValueList({"Canto": 0, "MDP": 1}, selected="MDP")
rh_in_19_4_canto_izquierdo_arriba = ValueList({"Canto": 0, "MDP": 1}, selected="Canto")
rh_in_19_5_canto_derecho_abajo = ValueList({"Canto": 0, "MDP": 1}, selected="MDP")
rh_in_19_0_mapeado = ValueList({"Longitudinal": 0, "Atravesada": 1}, selected="Longitudinal")
python_3_script_48 = Python3Script(
    Brep_In=stream_filter_10,
    Balance_Mode=rh_in_19_1_lado_balance,
    Canto_1=rh_in_19_2_canto_frontal,
    Canto_2=rh_in_19_3_canto_trasero,
    Canto_3=rh_in_19_4_canto_izquierdo_arriba,
    Canto_4=rh_in_19_5_canto_derecho_abajo)  # -> Out, NURBS_Color, NURBS_Balance, NURBS_MDP, Info_Pieza; inputs Brep_In: Brep, Balance_Mode: String, Canto_1: String, Canto_2: String, Canto_3: String, Canto_4: String
# ---------- python_3_script_48: Python ----------
"""
3BF Materializer v0.2.1 (Estandarizado Universal)
Canto_1: Extremo 1 (Frontal / Izquierdo)
Canto_2: Extremo 2 (Trasero / Derecho)
Canto_3: SIEMPRE ARRIBA / SUPERIOR (+Z) con soporte para chaflán a 45°
Canto_4: SIEMPRE ABAJO / INFERIOR (-Z)
"""

import Rhino

def parse_balance(val):
    s = str(val).lower().strip().replace('"', '').replace("'", "")
    if s in ["6", "d/d", "dyd", "doble", "ninguno", "ambas"] or "d/d" in s or "dyd" in s:
        return "DD"
    if s in ["5", "cara a", "a"] or (s.startswith("a") and len(s) <= 6):
        return "A"
    if s in ["4", "cara b", "b"] or (s.startswith("b") and len(s) <= 6):
        return "B"
    if "ambos" in s:
        return "AMBOS"
    return "B"

def parse_canto(val):
    s = str(val).lower().strip().replace('"', '').replace("'", "")
    if s in ["0", "0.0", "canto", "true", "si", "sí", "con canto"] or ("canto" in s and "sin" not in s):
        return True # Madera / Color
    if s in ["1", "1.0", "mdp", "false", "no", "sin canto"] or "mdp" in s or "sin" in s:
        return False # Crudo / MDP
    return True

def desglosar_pieza_real_nurbs(brep_in, balance_mode="Cara B", c1="Canto", c2="Canto", c3="Canto", c4="Canto"):
    if brep_in is None:
        return [], [], [], "Brep de entrada es nulo"

    bbox = brep_in.GetBoundingBox(True)
    x0, x1 = bbox.Min.X, bbox.Max.X
    y0, y1 = bbox.Min.Y, bbox.Max.Y
    z0, z1 = bbox.Min.Z, bbox.Max.Z

    sx = max(0.1, x1 - x0)
    sy = max(0.1, y1 - y0)
    sz = max(0.1, z1 - z0)
    min_dim = min(sx, sy, sz)

    tol = max(0.2, min_dim * 0.15)
    zona_bisel = max(tol * 2.5, min_dim * 2.5)

    faces_A = []
    faces_B = []
    faces_cantos = {1: [], 2: [], 3: [], 4: []}
    faces_mecanizados = []

    for i in range(brep_in.Faces.Count):
        f = brep_in.Faces[i]
        u = (f.Domain(0).T0 + f.Domain(0).T1) * 0.5
        v = (f.Domain(1).T0 + f.Domain(1).T1) * 0.5
        pt = f.PointAt(u, v)
        n = f.NormalAt(u, v)
        n.Unitize()
        nurbs_face = f.DuplicateFace(False)

        # -------------------------------------------------------------
        # CASO 1: Tablero Horizontal (Cubiertas / Entrepaños - Espesor en Z)
        # -------------------------------------------------------------
        if min_dim == sz:
            tipo_str = "Horizontal (Cubierta/Entrepaño)"
            if n.Z > 0.85 and abs(pt.Z - z1) < tol:
                faces_A.append(nurbs_face)
            elif n.Z < -0.85 and abs(pt.Z - z0) < tol:
                faces_B.append(nurbs_face)
            elif n.Y < -0.20 and (pt.Y - y0) < zona_bisel:
                faces_cantos[1].append(nurbs_face) # Frontal
            elif n.Y > 0.20 and (y1 - pt.Y) < zona_bisel:
                faces_cantos[2].append(nurbs_face) # Trasero
            elif n.X < -0.20 and (pt.X - x0) < zona_bisel:
                faces_cantos[3].append(nurbs_face) # Izquierdo
            elif n.X > 0.20 and (x1 - pt.X) < zona_bisel:
                faces_cantos[4].append(nurbs_face) # Derecho
            else:
                faces_mecanizados.append(nurbs_face)

        # -------------------------------------------------------------
        # CASO 2: Tablero Vertical Lateral (Costados / Parales - Espesor en X)
        # -------------------------------------------------------------
        elif min_dim == sx:
            tipo_str = "Vertical Lateral (Costado/Paral)"
            if n.X > 0.85 and abs(pt.X - x1) < tol:
                faces_A.append(nurbs_face)
            elif n.X < -0.85 and abs(pt.X - x0) < tol:
                faces_B.append(nurbs_face)
            elif n.Y < -0.20 and (pt.Y - y0) < zona_bisel:
                faces_cantos[1].append(nurbs_face) # Frontal
            elif n.Y > 0.20 and (y1 - pt.Y) < zona_bisel:
                faces_cantos[2].append(nurbs_face) # Trasero
            elif n.Z > 0.20 and (z1 - pt.Z) < zona_bisel:
                faces_cantos[3].append(nurbs_face) # Superior (ARRIBA)
            elif n.Z < -0.20 and (pt.Z - z0) < zona_bisel:
                faces_cantos[4].append(nurbs_face) # Inferior (ABAJO)
            else:
                faces_mecanizados.append(nurbs_face)

        # -------------------------------------------------------------
        # CASO 3: Tablero Vertical Frontal (Frentes / Traviesas - Espesor en Y)
        # -------------------------------------------------------------
        else:
            tipo_str = "Vertical Frontal (Frente/Traviesa)"
            if n.Y < -0.85 and abs(pt.Y - y0) < tol:
                faces_A.append(nurbs_face)
            elif n.Y > 0.85 and abs(pt.Y - y1) < tol:
                faces_B.append(nurbs_face)
            # Canto 1: Lateral Izquierdo (-X)
            elif n.X < -0.20 and (pt.X - x0) < zona_bisel:
                faces_cantos[1].append(nurbs_face)
            # Canto 2: Lateral Derecho (+X)
            elif n.X > 0.20 and (x1 - pt.X) < zona_bisel:
                faces_cantos[2].append(nurbs_face)
            # Canto 3: SIEMPRE SUPERIOR / ARRIBA (+Z, plano o chaflán a 45°)
            elif n.Z > 0.20 and (z1 - pt.Z) < zona_bisel:
                faces_cantos[3].append(nurbs_face)
            # Canto 4: SIEMPRE INFERIOR / ABAJO (-Z)
            elif n.Z < -0.20 and (pt.Z - z0) < zona_bisel:
                faces_cantos[4].append(nurbs_face)
            else:
                faces_mecanizados.append(nurbs_face)

    modo_b = parse_balance(balance_mode)
    nurbs_color = []
    nurbs_balance = []
    nurbs_mdp = []

    if modo_b == "DD":
        nurbs_color.extend(faces_A)
        nurbs_color.extend(faces_B)
        diag_bal = "D/D (Ambas Caras Madera)"
    elif modo_b == "A":
        nurbs_balance.extend(faces_A)
        nurbs_color.extend(faces_B)
        diag_bal = "Balance Cara A"
    elif modo_b == "B":
        nurbs_color.extend(faces_A)
        nurbs_balance.extend(faces_B)
        diag_bal = "Balance Cara B"
    else:
        nurbs_balance.extend(faces_A)
        nurbs_balance.extend(faces_B)
        diag_bal = "Ambos Balance"

    cantos_in = {
        1: parse_canto(c1),
        2: parse_canto(c2),
        3: parse_canto(c3),
        4: parse_canto(c4)
    }

    c_color_count = 0
    for num_canto, tiene_canto in cantos_in.items():
        if tiene_canto:
            nurbs_color.extend(faces_cantos[num_canto])
            c_color_count += len(faces_cantos[num_canto])
        else:
            nurbs_mdp.extend(faces_cantos[num_canto])

    nurbs_mdp.extend(faces_mecanizados)

    diag = "{0} | {1} | Total Caras: {2} (A={3}, B={4}, Cantos={5}, Mecanizados={6}) | Breps Salida -> Color: {7}, Balance: {8}, MDP: {9}".format(
        tipo_str, diag_bal, brep_in.Faces.Count,
        len(faces_A), len(faces_B), sum(len(v) for v in faces_cantos.values()), len(faces_mecanizados),
        len(nurbs_color), len(nurbs_balance), len(nurbs_mdp)
    )

    return nurbs_color, nurbs_balance, nurbs_mdp, diag


n_col, n_bal, n_mdp, diag_txt = desglosar_pieza_real_nurbs(
    Brep_In,
    Balance_Mode if 'Balance_Mode' in locals() else "Cara B",
    Canto_1 if 'Canto_1' in locals() else "Canto",
    Canto_2 if 'Canto_2' in locals() else "Canto",
    Canto_3 if 'Canto_3' in locals() else "Canto",
    Canto_4 if 'Canto_4' in locals() else "Canto"
)

NURBS_Color = n_col
Nurbs_Color = n_col
nurbs_color = n_col
Mesh_Color = n_col

NURBS_Balance = n_bal
Nurbs_Balance = n_bal
nurbs_balance = n_bal
Mesh_Balance = n_bal

NURBS_MDP = n_mdp
Nurbs_MDP = n_mdp
nurbs_mdp = n_mdp
Mesh_MDP = n_mdp

Info_Pieza = diag_txt
# ---------- end python_3_script_48 ----------
mesh_brep_28 = MeshBrep(
    Brep=python_3_script_48.NURBS_Color,
    Settings={GridMaxCount=0, GridMinCount=16, JaggedSeams=False, MaxEdgeLength=0, MinEdgeLength=0.0001, MinTolerance=0, Refine=True, RefineAngle=0, RelativeTolerance=0.65, SimplePlanes=True, Tolerance=0})
mesh_brep_29 = MeshBrep(
    Brep=python_3_script_48.NURBS_Balance,
    Settings={GridMaxCount=0, GridMinCount=16, JaggedSeams=False, MaxEdgeLength=0, MinEdgeLength=0.0001, MinTolerance=0, Refine=True, RefineAngle=0, RelativeTolerance=0.65, SimplePlanes=True, Tolerance=0})
mesh_brep_30 = MeshBrep(
    Brep=python_3_script_48.NURBS_MDP,
    Settings={GridMaxCount=0, GridMinCount=16, JaggedSeams=False, MaxEdgeLength=0, MinEdgeLength=0.0001, MinTolerance=0, Refine=True, RefineAngle=0, RelativeTolerance=0.65, SimplePlanes=True, Tolerance=0})
diagnostico_21 = Panel(python_3_script_48.Info_Pieza)
mesh_join_28 = MeshJoin(Meshes=flatten(mesh_brep_28))
mesh_join_29 = MeshJoin(Meshes=flatten(mesh_brep_29))
mesh_join_30 = MeshJoin(Meshes=flatten(mesh_brep_30))
python_3_script_49 = Python3Script(M=mesh_join_28, B=rh_in_19_0_mapeado)  # -> a; inputs M: Mesh, B: Int32
# ---------- python_3_script_49: Python ----------
"""
3BF Box Mapping Profesional v0.4
Desglose y Mapeado DfMA Multi-Pieza:
1. Detecta y separa automáticamente piezas desconectadas fusionadas por Mesh Join.
2. Calcula el Bounding Box individual real de cada pieza (426.5 mm en lugar de 857 mm).
3. Asegura veta longitudinal en cantos superiores de laterales de cajón (hacia el fondo).
4. Emite cada pieza física por separado para que el despiece reporte la cantidad y largo exactos.
"""

import Rhino

def mapear_pieza_individual(mesh, modo_veta=0, escala_caja_mm=600.0):
    if mesh is None or not isinstance(mesh, Rhino.Geometry.Mesh):
        return mesh

    mesh.Unweld(0.0, True)
    mesh.Normals.ComputeNormals()
    mesh.TextureCoordinates.Clear()

    # Bounding Box individual y estricto de ESTA pieza sola (ej: 426.5 x 221 x 15 mm)
    bbox = mesh.GetBoundingBox(True)
    sx = max(1.0, bbox.Max.X - bbox.Min.X)
    sy = max(1.0, bbox.Max.Y - bbox.Min.Y)
    sz = max(1.0, bbox.Max.Z - bbox.Min.Z)

    es_atravesada = False
    if isinstance(modo_veta, str):
        es_atravesada = "atravesad" in modo_veta.lower() or modo_veta in ["1", "3", "5"]
    elif isinstance(modo_veta, (int, float)):
        es_atravesada = int(modo_veta) in [1, 3, 5]

    escala = float(escala_caja_mm)

    for idx in range(mesh.Vertices.Count):
        v = mesh.Vertices[idx]
        n = mesh.Normals[idx] if idx < mesh.Normals.Count else Rhino.Geometry.Vector3f(0, 0, 1)

        lx = v.X - bbox.Min.X
        ly = v.Y - bbox.Min.Y
        lz = v.Z - bbox.Min.Z

        nx, ny, nz = abs(n.X), abs(n.Y), abs(n.Z)

        # -------------------------------------------------------------
        # CASO A: Cara Superior / Inferior (Normal mirando en Z)
        # -------------------------------------------------------------
        if nz >= nx and nz >= ny:
            if sy >= sx:
                # Lateral de cajón hacia el fondo (ej: 350mm en Y vs 15mm en X)
                u = ly / escala
                v_coord = lx / escala
            else:
                # Tablero horizontal normal o canto superior de frente (largo en X)
                u = ly / escala if es_atravesada else lx / escala
                v_coord = lx / escala if es_atravesada else ly / escala

        # -------------------------------------------------------------
        # CASO B: Cara Frontal / Trasera (Normal mirando en Y)
        # -------------------------------------------------------------
        elif ny >= nx and ny >= nz:
            if sx >= sz:
                # Frente de cajón o traviesa horizontal (ancho en X)
                u = lz / escala if es_atravesada else lx / escala
                v_coord = lx / escala if es_atravesada else lz / escala
            else:
                # Pieza vertical alta
                u = lz / escala
                v_coord = lx / escala

        # -------------------------------------------------------------
        # CASO C: Cara Lateral Izquierda / Derecha (Normal mirando en X)
        # -------------------------------------------------------------
        else:
            if sy >= sz:
                # Cara plana del lateral de cajón (hacia el fondo en Y)
                u = lz / escala if es_atravesada else ly / escala
                v_coord = ly / escala if es_atravesada else lz / escala
            else:
                # Costado vertical de mueble
                u = ly / escala if es_atravesada else lz / escala
                v_coord = lz / escala if es_atravesada else ly / escala

        mesh.TextureCoordinates.Add(float(u), float(v_coord))

    return mesh


def desglosar_y_mapear(mesh_in, modo_veta=0, escala_caja_mm=600.0):
    if mesh_in is None:
        return []

    mesh = mesh_in.DuplicateMesh() if hasattr(mesh_in, "DuplicateMesh") else mesh_in
    if not isinstance(mesh, Rhino.Geometry.Mesh):
        return [mesh_in]

    # Separar piezas independientes desconectadas que vinieron agrupadas
    piezas = mesh.SplitDisjointPieces()
    if piezas is not None and len(piezas) > 1:
        resultado = []
        for p in piezas:
            mp = mapear_pieza_individual(p, modo_veta, escala_caja_mm)
            if mp is not None:
                resultado.append(mp)
        return resultado
    else:
        mp = mapear_pieza_individual(mesh, modo_veta, escala_caja_mm)
        return [mp] if mp is not None else []


# Ejecución universal compatible con Item Access o List Access
lista_salida = []

def procesar_recursivo(item):
    if item is None:
        return
    if isinstance(item, (list, tuple)):
        for sub in item:
            procesar_recursivo(sub)
    else:
        piezas = desglosar_y_mapear(item, B if 'B' in locals() else 0, 600.0)
        lista_salida.extend(piezas)

procesar_recursivo(M)
a = lista_salida
# ---------- end python_3_script_49 ----------
python_3_script_50 = Python3Script(M=mesh_join_29, B=rh_in_19_0_mapeado)  # -> a; inputs M: Mesh, B: Int32; same code as python_3_script_49
python_3_script_51 = Python3Script(M=mesh_join_30, B=rh_in_19_0_mapeado)  # -> a; inputs M: Mesh, B: Int32; same code as python_3_script_49
linear_array_7 = LinearArray(Geometry=python_3_script_49, Direction=negative, Count=cantidad_cajones)  # -> Geometry, Transform
linear_array_8 = LinearArray(Geometry=python_3_script_51, Direction=negative, Count=cantidad_cajones)  # -> Geometry, Transform
linear_array_9 = LinearArray(Geometry=python_3_script_50, Direction=negative, Count=cantidad_cajones)  # -> Geometry, Transform
rh_out_mdp_peça_16 = Geometry(linear_array_8.Geometry)
rh_out_peça_16 = Geometry(linear_array_7.Geometry)
rh_out_peça_16_b = Geometry(linear_array_9.Geometry)

# ----
mirror_13 = Mirror(Geometry=move_66.Geometry, Plane=yz_plane_4)  # -> Geometry, Transform
mirror_14 = Mirror(Geometry=move_67.Geometry, Plane=yz_plane_4)  # -> Geometry, Transform
mirror_15 = Mirror(Geometry=move_68.Geometry, Plane=yz_plane_4)  # -> Geometry, Transform
mirror_16 = Mirror(Geometry=move_69.Geometry, Plane=yz_plane_4)  # -> Geometry, Transform
mirror_17 = Mirror(Geometry=move_65.Geometry, Plane=yz_plane_4)  # -> Geometry, Transform
mirror_18 = Mirror(Geometry=move_71.Geometry, Plane=yz_plane_4)  # -> Geometry, Transform
mirror_19 = Mirror(Geometry=move_70.Geometry, Plane=yz_plane_4)  # -> Geometry, Transform
rh_out_parafuso_e = Geometry([mirror_19.Geometry, move_70.Geometry])
move_97 = Move(Geometry=mirror_17.Geometry, Motion=unit_x)  # -> Geometry, Transform

# ---- group: Peça 6
solid_difference_5 = SolidDifference(BrepsA=box_2pt_3, BrepsB=move_97.Geometry)

# ---- group: Peça 10
solid_difference_6 = SolidDifference(BrepsA=mirror.Geometry, BrepsB=move_97.Geometry)

# ---- group: Peça 1
solid_difference_7 = SolidDifference(BrepsA=box_2pt_5, BrepsB=move_97.Geometry)

# ----
rh_out_clavilha = Geometry([mirror_18.Geometry, move_71.Geometry])
mirror_20 = Mirror(Geometry=[mirror_7.Geometry, move_73.Geometry, move_72.Geometry], Plane=yz_plane_4)  # -> Geometry, Transform

# ---- group: Peça 1 Aparência
# 3BF Materializer v0.1
rh_in_03_1_lado_balance = ValueList({"Cara A", "Cara B", "D/D"}, selected="D/D")
rh_in_03_2_canto_frontal = ValueList({"Canto": 0, "MDP": 1}, selected="MDP")
rh_in_03_3_canto_trasero = ValueList({"Canto": 0, "MDP": 1}, selected="MDP")
rh_in_03_4canto_izquierdo_arriba = ValueList({"Canto": 0, "MDP": 1}, selected="MDP")
rh_in_03_5_canto_derecho_abajo = ValueList({"Canto": 0, "MDP": 1}, selected="MDP")
rh_in_03_0_mapeado = ValueList({"Longitudinal": 0, "Atravesada": 1}, selected="Longitudinal")
python_3_script_52 = Python3Script(
    Brep_In=solid_difference_7,
    Balance_Mode=rh_in_03_1_lado_balance,
    Canto_1=rh_in_03_2_canto_frontal,
    Canto_2=rh_in_03_3_canto_trasero,
    Canto_3=rh_in_03_4canto_izquierdo_arriba,
    Canto_4=rh_in_03_5_canto_derecho_abajo)  # -> Out, NURBS_Color, NURBS_Balance, NURBS_MDP, Info_Pieza; inputs Brep_In: Brep, Balance_Mode: String, Canto_1: String, Canto_2: String, Canto_3: String, Canto_4: String; same code as python_3_script_31
mesh_brep_31 = MeshBrep(
    Brep=python_3_script_52.NURBS_Color,
    Settings={GridMaxCount=0, GridMinCount=16, JaggedSeams=False, MaxEdgeLength=0, MinEdgeLength=0.0001, MinTolerance=0, Refine=True, RefineAngle=0, RelativeTolerance=0.65, SimplePlanes=True, Tolerance=0})
mesh_brep_32 = MeshBrep(
    Brep=python_3_script_52.NURBS_Balance,
    Settings={GridMaxCount=0, GridMinCount=16, JaggedSeams=False, MaxEdgeLength=0, MinEdgeLength=0.0001, MinTolerance=0, Refine=True, RefineAngle=0, RelativeTolerance=0.65, SimplePlanes=True, Tolerance=0})
mesh_brep_33 = MeshBrep(
    Brep=python_3_script_52.NURBS_MDP,
    Settings={GridMaxCount=0, GridMinCount=16, JaggedSeams=False, MaxEdgeLength=0, MinEdgeLength=0.0001, MinTolerance=0, Refine=True, RefineAngle=0, RelativeTolerance=0.65, SimplePlanes=True, Tolerance=0})
diagnostico_22 = Panel(python_3_script_52.Info_Pieza)
mesh_join_31 = MeshJoin(Meshes=flatten(mesh_brep_31))
mesh_join_32 = MeshJoin(Meshes=flatten(mesh_brep_32))
mesh_join_33 = MeshJoin(Meshes=flatten(mesh_brep_33))
python_3_script_53 = Python3Script(M=mesh_join_31, B=rh_in_03_0_mapeado)  # -> a; inputs M: Mesh, B: Int32; same code as python_3_script_32
python_3_script_54 = Python3Script(M=mesh_join_32, B=rh_in_03_0_mapeado)  # -> a; inputs M: Mesh, B: Int32; same code as python_3_script_32
python_3_script_55 = Python3Script(M=mesh_join_33, B=rh_in_03_0_mapeado)  # -> a; inputs M: Mesh, B: Int32; same code as python_3_script_32
rh_out_peça_1 = Geometry(python_3_script_53)
rh_out_mdp_peça_1 = Geometry(python_3_script_55)

# ---- group: Peça 10 Aparência
# 3BF Materializer v0.1
rh_in_13_1_lado_balance = ValueList({"Cara A", "Cara B", "D/D"}, selected="Cara B")
rh_in_13_2_canto_frontal = ValueList({"Canto": 0, "MDP": 1}, selected="Canto")
rh_in_13_3_canto_trasero = ValueList({"Canto": 0, "MDP": 1}, selected="MDP")
rh_in_13_4canto_izquierdo_arriba = ValueList({"Canto": 0, "MDP": 1}, selected="MDP")
rh_in_13_5_canto_derecho_abajo = ValueList({"Canto": 0, "MDP": 1}, selected="MDP")
rh_in_13_0_mapeado = ValueList({"Longitudinal": 1, "Atravesada": 0}, selected="Longitudinal")
python_3_script_56 = Python3Script(
    Brep_In=solid_difference_6,
    Balance_Mode=rh_in_13_1_lado_balance,
    Canto_1=rh_in_13_2_canto_frontal,
    Canto_2=rh_in_13_3_canto_trasero,
    Canto_3=rh_in_13_4canto_izquierdo_arriba,
    Canto_4=rh_in_13_5_canto_derecho_abajo)  # -> Out, NURBS_Color, NURBS_Balance, NURBS_MDP, Info_Pieza; inputs Brep_In: Brep, Balance_Mode: String, Canto_1: String, Canto_2: String, Canto_3: String, Canto_4: String; same code as python_3_script_31
mesh_brep_34 = MeshBrep(
    Brep=python_3_script_56.NURBS_Color,
    Settings={GridMaxCount=0, GridMinCount=16, JaggedSeams=False, MaxEdgeLength=0, MinEdgeLength=0.0001, MinTolerance=0, Refine=True, RefineAngle=0, RelativeTolerance=0.65, SimplePlanes=True, Tolerance=0})
mesh_brep_35 = MeshBrep(
    Brep=python_3_script_56.NURBS_Balance,
    Settings={GridMaxCount=0, GridMinCount=16, JaggedSeams=False, MaxEdgeLength=0, MinEdgeLength=0.0001, MinTolerance=0, Refine=True, RefineAngle=0, RelativeTolerance=0.65, SimplePlanes=True, Tolerance=0})
mesh_brep_36 = MeshBrep(
    Brep=python_3_script_56.NURBS_MDP,
    Settings={GridMaxCount=0, GridMinCount=16, JaggedSeams=False, MaxEdgeLength=0, MinEdgeLength=0.0001, MinTolerance=0, Refine=True, RefineAngle=0, RelativeTolerance=0.65, SimplePlanes=True, Tolerance=0})
diagnostico_23 = Panel(python_3_script_56.Info_Pieza)
mesh_join_34 = MeshJoin(Meshes=flatten(mesh_brep_34))
mesh_join_35 = MeshJoin(Meshes=flatten(mesh_brep_35))
mesh_join_36 = MeshJoin(Meshes=flatten(mesh_brep_36))
python_3_script_57 = Python3Script(M=mesh_join_34, B=rh_in_13_0_mapeado)  # -> a; inputs M: Mesh, B: Int32; same code as python_3_script_32
python_3_script_58 = Python3Script(M=mesh_join_35, B=rh_in_13_0_mapeado)  # -> a; inputs M: Mesh, B: Int32; same code as python_3_script_32
python_3_script_59 = Python3Script(M=mesh_join_36, B=rh_in_13_0_mapeado)  # -> a; inputs M: Mesh, B: Int32; same code as python_3_script_32
rh_out_peça_10_b = Geometry(python_3_script_58)
rh_out_peça_10 = Geometry(python_3_script_57)
rh_out_mdp_peça_10 = Geometry(python_3_script_59)

# ---- group: Peça 6 Aparência
# 3BF Materializer v0.2.1
rh_in_09_4_canto_izquierdo_arriba = ValueList({"Canto": 0, "MDP": 1}, selected="MDP")
rh_in_09_1_lado_balance = ValueList({"Cara A", "Cara B", "D/D"}, selected="Cara A")
rh_in_09_2_canto_frontal = ValueList({"Canto": 0, "MDP": 1}, selected="Canto")
rh_in_09_3_canto_trasero = ValueList({"Canto": 0, "MDP": 1}, selected="MDP")
rh_in_09_5_canto_derecho_abajo = ValueList({"Canto": 0, "MDP": 1}, selected="MDP")
rh_in_09_0_mapeado = ValueList({"Longitudinal": 1, "Atravesada": 0}, selected="Longitudinal")
python_3_script_60 = Python3Script(
    Brep_In=solid_difference_5,
    Balance_Mode=rh_in_09_1_lado_balance,
    Canto_1=rh_in_09_2_canto_frontal,
    Canto_2=rh_in_09_3_canto_trasero,
    Canto_3=rh_in_09_4_canto_izquierdo_arriba,
    Canto_4=rh_in_09_5_canto_derecho_abajo)  # -> Out, NURBS_Color, NURBS_Balance, NURBS_MDP, Info_Pieza; inputs Brep_In: Brep, Balance_Mode: String, Canto_1: String, Canto_2: String, Canto_3: String, Canto_4: String; same code as python_3_script_48
mesh_brep_37 = MeshBrep(
    Brep=python_3_script_60.NURBS_Color,
    Settings={GridMaxCount=0, GridMinCount=16, JaggedSeams=False, MaxEdgeLength=0, MinEdgeLength=0.0001, MinTolerance=0, Refine=True, RefineAngle=0, RelativeTolerance=0.65, SimplePlanes=True, Tolerance=0})
mesh_brep_38 = MeshBrep(
    Brep=python_3_script_60.NURBS_Balance,
    Settings={GridMaxCount=0, GridMinCount=16, JaggedSeams=False, MaxEdgeLength=0, MinEdgeLength=0.0001, MinTolerance=0, Refine=True, RefineAngle=0, RelativeTolerance=0.65, SimplePlanes=True, Tolerance=0})
mesh_brep_39 = MeshBrep(
    Brep=python_3_script_60.NURBS_MDP,
    Settings={GridMaxCount=0, GridMinCount=16, JaggedSeams=False, MaxEdgeLength=0, MinEdgeLength=0.0001, MinTolerance=0, Refine=True, RefineAngle=0, RelativeTolerance=0.65, SimplePlanes=True, Tolerance=0})
diagnostico_24 = Panel(python_3_script_60.Info_Pieza)
mesh_join_37 = MeshJoin(Meshes=flatten(mesh_brep_37))
mesh_join_38 = MeshJoin(Meshes=flatten(mesh_brep_38))
mesh_join_39 = MeshJoin(Meshes=flatten(mesh_brep_39))
python_3_script_61 = Python3Script(M=mesh_join_37, B=rh_in_09_0_mapeado)  # -> a; inputs M: Mesh, B: Int32; same code as python_3_script_32
python_3_script_62 = Python3Script(M=mesh_join_38, B=rh_in_09_0_mapeado)  # -> a; inputs M: Mesh, B: Int32; same code as python_3_script_32
python_3_script_63 = Python3Script(M=mesh_join_39, B=rh_in_09_0_mapeado)  # -> a; inputs M: Mesh, B: Int32; same code as python_3_script_32
rh_out_mdp_peça_6 = Geometry(python_3_script_63)
rh_out_peça_6_b = Geometry(python_3_script_62)
rh_out_peça_6 = Geometry(python_3_script_61)

# ----
rh_out_cavilha = Geometry([mirror_20.Geometry, move_72.Geometry, move_73.Geometry, mirror_7.Geometry])

# ---- group: Peça 1 Aparência / RH_OUT:Peça 1 B
rh_out_peça_10_b_2 = Geometry(python_3_script_54)

# ----
move_98 = Move(Geometry=move_93.Geometry, Motion=unit_x_17)  # -> Geometry, Transform
move_99 = Move(Geometry=move_98.Geometry, Motion=unit_y_29)  # -> Geometry, Transform

# ---- group: Fondo de cajon
box_2pt_20 = Box2Pt(PointA=move_99.Geometry, PointB=mirror_9.Geometry, Plane=PlaneXY(0, 0, 0))

# ----
move_100 = Move(Geometry=box_2pt_20, Motion=vector_2pt_9.Vector)  # -> Geometry, Transform
stream_filter_11 = StreamFilter(Gate=expression_2, Stream1=box_2pt_20, Stream2=[move_100.Geometry, box_2pt_20])

# ---- group: Peça 18 Aparência
# FONDOS
# 3BF Materializer v0.3
# 3BF Box Mapping v1.0 Fondos
# 3BF Mesh Channel Separator v2.4  Fondos
rh_in_21_0_mapeado = ValueList({"Longitudinal": 0, "Atravesada": 1}, selected="Longitudinal")
python_3_script_64 = Python3Script(Brep_In=stream_filter_11)  # -> out, Pieza_1, Pieza_2, Pieza_3, Pieza_4; inputs Brep_In: list of Brep; same code as python_3_script
mesh_brep_40 = MeshBrep(
    Brep=python_3_script_64.Pieza_2,
    Settings={GridMaxCount=0, GridMinCount=16, JaggedSeams=False, MaxEdgeLength=0, MinEdgeLength=0.0001, MinTolerance=0, Refine=True, RefineAngle=0, RelativeTolerance=0.65, SimplePlanes=True, Tolerance=0})
mesh_brep_41 = MeshBrep(
    Brep=python_3_script_64.Pieza_1,
    Settings={GridMaxCount=0, GridMinCount=16, JaggedSeams=False, MaxEdgeLength=0, MinEdgeLength=0.0001, MinTolerance=0, Refine=True, RefineAngle=0, RelativeTolerance=0.65, SimplePlanes=True, Tolerance=0})
diagnostico_25 = Panel(python_3_script_64.out)
rh_in_21_1_lado_color = ValueList({"Cara A", "Cara B"}, selected="Cara A")
rh_in_21_2_sustrato = ValueList({"MDF 1 Cara": "MDF 1 cara", "Doble Cara (D/D)": "DD", "MDF Crudo": "Crudo", "Con Balance": "Balance"}, selected="MDF 1 Cara")
mesh_join_40 = MeshJoin(Meshes=flatten(mesh_brep_40))
mesh_join_41 = MeshJoin(Meshes=flatten(mesh_brep_41))
python_3_script_65 = Python3Script(M=mesh_join_41, B=rh_in_21_0_mapeado)  # -> a; inputs M: Mesh, B: Int32
# ---------- python_3_script_65: Python ----------
"""
=============================================================================
3BF Box Mapping v1.0 Fondos (Thin Sheet MDF Specialized - Fix Salidas)
Powered by 3dBimFab
=============================================================================
Mapeado de textura UV optimizado para tableros delgados de 3 mm / 6 mm:
- Identifica automáticamente el plano dominante del fondo (XY, XZ o YZ).
- Proyecta UVs continuas a escala métrica estándar (600 mm).
- Modo de Veta (B / S):
  * 0 / "Longitudinal": La veta corre a lo largo del lado más largo del fondo.
  * 1 / "Atravesada": La veta corre a lo largo del lado transversal.
- Preserva la cohesión total de la malla sin despiece destructivo.
- Asigna explícitamente a la salida 'a' para alimentar el Linear Array.
=============================================================================
"""
import Rhino

def aplicar_box_mapping_fondo(mesh_in, modo_veta=0, escala_caja_mm=600.0):
    if mesh_in is None:
        return None

    mesh = mesh_in
    if hasattr(mesh_in, "Value"):
        mesh = mesh_in.Value

    if not isinstance(mesh, Rhino.Geometry.Mesh):
        return mesh_in

    m = mesh.DuplicateMesh() if hasattr(mesh, "DuplicateMesh") else mesh
    m.Normals.ComputeNormals()
    m.TextureCoordinates.Clear()

    bbox = m.GetBoundingBox(True)
    if not bbox.IsValid:
        return m

    sx = max(0.1, bbox.Max.X - bbox.Min.X)
    sy = max(0.1, bbox.Max.Y - bbox.Min.Y)
    sz = max(0.1, bbox.Max.Z - bbox.Min.Z)

    # Identificar el eje de espesor (mínima dimensión) y los dos lados del plano
    dims = [("X", sx), ("Y", sy), ("Z", sz)]
    dims.sort(key=lambda d: d[1])
    eje_espesor = dims[0][0]

    es_atravesada = False
    if isinstance(modo_veta, str):
        es_atravesada = "atravesad" in modo_veta.lower() or modo_veta in ["1", "3", "5"]
    elif isinstance(modo_veta, (int, float)):
        es_atravesada = int(modo_veta) in [1, 3, 5]

    escala = float(escala_caja_mm)

    v_count = m.Vertices.Count
    norm_count = m.Normals.Count

    for idx in range(v_count):
        v = m.Vertices[idx]
        n = m.Normals[idx] if idx < norm_count else Rhino.Geometry.Vector3f(0, 0, 1)

        lx = v.X - bbox.Min.X
        ly = v.Y - bbox.Min.Y
        lz = v.Z - bbox.Min.Z

        nx, ny, nz = abs(n.X), abs(n.Y), abs(n.Z)

        # -----------------------------------------------------------------
        # CASO 1: Fondo Horizontal (Espesor en Z, caras principales en XY)
        # -----------------------------------------------------------------
        if eje_espesor == "Z":
            if nz >= nx and nz >= ny:
                # Caras principales A / B
                if sx >= sy:
                    u = ly / escala if es_atravesada else lx / escala
                    v_coord = lx / escala if es_atravesada else ly / escala
                else:
                    u = lx / escala if es_atravesada else ly / escala
                    v_coord = ly / escala if es_atravesada else lx / escala
            elif ny >= nx:
                # Cantos en Y
                u = lx / escala
                v_coord = lz / escala
            else:
                # Cantos en X
                u = ly / escala
                v_coord = lz / escala

        # -----------------------------------------------------------------
        # CASO 2: Fondo Vertical Trasero (Espesor en Y, caras en XZ)
        # -----------------------------------------------------------------
        elif eje_espesor == "Y":
            if ny >= nx and ny >= nz:
                # Caras principales A / B
                if sx >= sz:
                    u = lz / escala if es_atravesada else lx / escala
                    v_coord = lx / escala if es_atravesada else lz / escala
                else:
                    u = lx / escala if es_atravesada else lz / escala
                    v_coord = lz / escala if es_atravesada else lx / escala
            elif nz >= nx:
                # Cantos en Z
                u = lx / escala
                v_coord = ly / escala
            else:
                # Cantos en X
                u = lz / escala
                v_coord = ly / escala

        # -----------------------------------------------------------------
        # CASO 3: Fondo Vertical Lateral (Espesor en X, caras en YZ)
        # -----------------------------------------------------------------
        else:
            if nx >= ny and nx >= nz:
                # Caras principales A / B
                if sy >= sz:
                    u = lz / escala if es_atravesada else ly / escala
                    v_coord = ly / escala if es_atravesada else lz / escala
                else:
                    u = ly / escala if es_atravesada else lz / escala
                    v_coord = lz / escala if es_atravesada else ly / escala
            elif nz >= ny:
                # Cantos en Z
                u = ly / escala
                v_coord = lx / escala
            else:
                # Cantos en Y
                u = lz / escala
                v_coord = lx / escala

        m.TextureCoordinates.Add(float(u), float(v_coord))

    return m

# 1. Leer Modo de Veta desde cualquiera de los nombres de entrada (B o S)
modo_s = B if 'B' in locals() else (S if 'S' in locals() else 0)

# 2. Procesar malla o lista de mallas
if isinstance(M, list):
    resultado = [aplicar_box_mapping_fondo(item, modo_s, 600.0) for item in M if item is not None]
else:
    resultado = aplicar_box_mapping_fondo(M, modo_s, 600.0)

# 3. Asignación a TODAS las posibles salidas del componente:
# 'a' es el pin oficial que conecta al Linear Array
a = resultado
M = resultado
out = resultado
# ---------- end python_3_script_65 ----------
python_3_script_66 = Python3Script(M=mesh_join_40, B=rh_in_21_0_mapeado)  # -> a; inputs M: Mesh, B: Int32; same code as python_3_script_65
linear_array_10 = LinearArray(Geometry=python_3_script_65, Direction=negative, Count=cantidad_cajones)  # -> Geometry, Transform

# ----
linear_array_11 = LinearArray(Geometry=python_3_script_66, Direction=negative, Count=cantidad_cajones)  # -> Geometry, Transform

# ---- group: Peça 18 Aparência (continued)
python_3_script_67 = Python3Script(
    M_In=[linear_array_10.Geometry, linear_array_11.Geometry],
    Lado_Color=rh_in_21_1_lado_color,
    Material_Mode=rh_in_21_2_sustrato)  # -> out, Color, Balance, MDF; inputs M_In: list of Mesh, Lado_Color: String, Material_Mode: String
# ---------- python_3_script_67: Python ----------
"""
=============================================================================
3BF Mesh Channel Separator v2.4 Fondos (Submesh UV & DfMA Aware)
Powered by 3dBimFab
=============================================================================
Entradas:
  - M_In: Mallas del fondo (Tree, List o Item). Type Hint: Mesh
  - Lado_Color: "Cara A" o "Cara B" (Value List).
  - Material_Mode: "MDF 1 Cara", "DD", "Crudo", "Balance" (Value List).
Salidas:
  - out: Consola de diagnóstico.
  - Color: Caras con acabado decorativo (Tono Fondo).
  - Balance: Contracara técnica (si aplica).
  - MDF: Cantos perimetrales y reverso en MDF crudo.
=============================================================================
"""
import Rhino
import rhinoscriptsyntax as rs

def extraer_malla_universal(c):
    if c is None: return None
    if isinstance(c, Rhino.Geometry.Mesh): return c
    if hasattr(c, "Faces") and hasattr(c, "Vertices"): return c
    val = getattr(c, "Value", c)
    if isinstance(val, Rhino.Geometry.Mesh): return val
    if hasattr(val, "Faces") and hasattr(val, "Vertices"): return val
    try:
        m = rs.coercemesh(c)
        if m: return m
    except:
        pass
    return None

def aplanar_candidatos(obj):
    res = []
    if obj is None: return res
    if hasattr(obj, "AllData"):
        for item in obj.AllData():
            m = extraer_malla_universal(item)
            if m: res.append(m)
        return res
    if hasattr(obj, "Branches"):
        for branch in obj.Branches:
            for item in branch:
                m = extraer_malla_universal(item)
                if m: res.append(m)
        return res
    if isinstance(obj, (list, tuple)):
        for item in obj:
            res.extend(aplanar_candidatos(item))
        return res
    m = extraer_malla_universal(obj)
    if m: res.append(m)
    return res

def parse_lado(val):
    s = str(val).lower().strip()
    if "b" in s: return "B"
    return "A"

def parse_material(val):
    s = str(val).lower().strip()
    if "dd" in s or "doble" in s or "2 cara" in s: return "DD"
    if "crudo" in s: return "CRUDO"
    if "balance" in s: return "BALANCE"
    return "MDF_1_CARA"

def crear_submalla_uv(mesh_origen, face_indices):
    """Extrae las caras indicadas preservando exactamente sus coordenadas de textura UV."""
    if not face_indices:
        return None
    sub = Rhino.Geometry.Mesh()
    vert_map = {}
    for fi in face_indices:
        f = mesh_origen.Faces[fi]
        idx_face = [f.A, f.B, f.C]
        if f.IsQuad:
            idx_face.append(f.D)

        nuevos_idx = []
        for vi in idx_face:
            if vi not in vert_map:
                new_vi = sub.Vertices.Add(mesh_origen.Vertices[vi])
                if mesh_origen.TextureCoordinates.Count > vi:
                    sub.TextureCoordinates.Add(mesh_origen.TextureCoordinates[vi])
                if mesh_origen.Normals.Count > vi:
                    sub.Normals.Add(mesh_origen.Normals[vi])
                vert_map[vi] = new_vi
            nuevos_idx.append(vert_map[vi])

        if len(nuevos_idx) == 3:
            sub.Faces.AddFace(nuevos_idx[0], nuevos_idx[1], nuevos_idx[2])
        elif len(nuevos_idx) == 4:
            sub.Faces.AddFace(nuevos_idx[0], nuevos_idx[1], nuevos_idx[2], nuevos_idx[3])

    sub.Normals.ComputeNormals()
    sub.Compact()
    return sub

# 1. Normalizar Entradas
lado_sel = parse_lado(Lado_Color if 'Lado_Color' in globals() and Lado_Color else "Cara A")
modo_mat = parse_material(Material_Mode if 'Material_Mode' in globals() and Material_Mode else "MDF 1 Cara")

# 2. Desempaquetar Mallas del Fondo
mallas_fondo = aplanar_candidatos(M_In if 'M_In' in globals() else None)

out_color = []
out_balance = []
out_mdf = []

for mesh in mallas_fondo:
    if not mesh or mesh.Faces.Count == 0:
        continue

    bb = mesh.GetBoundingBox(True)
    x0, x1 = bb.Min.X, bb.Max.X
    y0, y1 = bb.Min.Y, bb.Max.Y
    z0, z1 = bb.Min.Z, bb.Max.Z

    sx = max(0.1, x1 - x0)
    sy = max(0.1, y1 - y0)
    sz = max(0.1, z1 - z0)

    # Identificar el eje del espesor (en fondos casi siempre es Z)
    dims = [("X", sx), ("Y", sy), ("Z", sz)]
    dims.sort(key=lambda d: d[1])
    eje_esp = dims[0][0]
    espesor = dims[0][1]
    tol = max(0.3, espesor * 0.35)

    faces_A_idx = []
    faces_B_idx = []
    cantos_idx = []

    # Clasificar cada cara geométrica del sólido
    for fi in range(mesh.Faces.Count):
        f = mesh.Faces[fi]
        pts = [mesh.Vertices[f.A], mesh.Vertices[f.B], mesh.Vertices[f.C]]
        if f.IsQuad:
            pts.append(mesh.Vertices[f.D])

        cx = sum(p.X for p in pts) / len(pts)
        cy = sum(p.Y for p in pts) / len(pts)
        cz = sum(p.Z for p in pts) / len(pts)

        if eje_esp == "Z":
            if abs(cz - z1) < tol:
                faces_A_idx.append(fi)
            elif abs(cz - z0) < tol:
                faces_B_idx.append(fi)
            else:
                cantos_idx.append(fi)
        elif eje_esp == "Y":
            if abs(cy - y0) < tol:
                faces_A_idx.append(fi)
            elif abs(cy - y1) < tol:
                faces_B_idx.append(fi)
            else:
                cantos_idx.append(fi)
        else: # X
            if abs(cx - x1) < tol:
                faces_A_idx.append(fi)
            elif abs(cx - x0) < tol:
                faces_B_idx.append(fi)
            else:
                cantos_idx.append(fi)

    # 3. Lógica DfMA según Material_Mode y Lado_Color
    color_indices = []
    balance_indices = []
    mdf_indices = []

    if modo_mat == "DD":
        color_indices.extend(faces_A_idx)
        color_indices.extend(faces_B_idx)
        mdf_indices.extend(cantos_idx)
    elif modo_mat == "CRUDO":
        mdf_indices.extend(faces_A_idx)
        mdf_indices.extend(faces_B_idx)
        mdf_indices.extend(cantos_idx)
    elif modo_mat == "BALANCE":
        if lado_sel == "A":
            color_indices.extend(faces_A_idx)
            balance_indices.extend(faces_B_idx)
        else:
            color_indices.extend(faces_B_idx)
            balance_indices.extend(faces_A_idx)
        mdf_indices.extend(cantos_idx)
    else: # MDF_1_CARA (Estándar de Fábrica)
        if lado_sel == "A":
            color_indices.extend(faces_A_idx)
            mdf_indices.extend(faces_B_idx)
        else:
            color_indices.extend(faces_B_idx)
            mdf_indices.extend(faces_A_idx)
        mdf_indices.extend(cantos_idx)

    # 4. Generar las submallas UV independientes
    sub_color = crear_submalla_uv(mesh, color_indices)
    if sub_color: out_color.append(sub_color)

    sub_balance = crear_submalla_uv(mesh, balance_indices)
    if sub_balance: out_balance.append(sub_balance)

    sub_mdf = crear_submalla_uv(mesh, mdf_indices)
    if sub_mdf: out_mdf.append(sub_mdf)

# Asignar Salidas
Color = out_color
Balance = out_balance
MDF = out_mdf

print("Fondos: {} | Material: {} | Color: Cara {} -> Color={}, Balance={}, MDF={}".format(
    len(mallas_fondo), modo_mat, lado_sel, len(Color), len(Balance), len(MDF)
))
# ---------- end python_3_script_67 ----------
diagnostico_26 = Panel(python_3_script_67.out)
rh_out_mdf_peça_18 = Geometry(python_3_script_67.MDF)
rh_out_peça_18_b = Geometry(python_3_script_67.Balance)
rh_out_peça_18 = Geometry(python_3_script_67.Color)
